# Grasshopper definition team_03_working.gh (Grasshopper 1.0.8)
# plug-ins: Pufferfish, Swiftlet

# ----
# Connect MCP Tools to Decall and Update All Clusters
button = Button()
# IF SOMETHING IS NOT
# WORKING PRESS THIS
# BUTTON FIRST
toggle = BooleanToggle(True)
connect_mcp_tools_to_decall = CSharpScript(nickname_From="Central MCP Server", nickname_To="Central DeCall", connect=button)  # -> out; inputs nickname_From: String, nickname_To: String, connect: Boolean
# ---------- connect_mcp_tools_to_decall: C# ----------
using System;
using System.Linq;
using Grasshopper;
using Grasshopper.Kernel;

public class Script_Instance : GH_ScriptInstance
{
    private void RunScript(string nickname_From, string nickname_To, bool connect)
    {
        if (!connect) return;
        Console.Write($"Attempting to connect outputs from '{nickname_From}' to '{nickname_To}'...");

        var ghDoc = Instances.ActiveCanvas?.Document;
        if (ghDoc == null) return;

        var compFrom = ghDoc.Objects
            .OfType<IGH_Component>()
            .FirstOrDefault(o => o.NickName == nickname_From);

        var compTo = ghDoc.Objects
            .OfType<IGH_Param>()
            .FirstOrDefault(o => o.NickName == nickname_To);

        if (compFrom != null && compTo != null)
        {
            ghDoc.ScheduleSolution(5, doc => Connect(doc, compFrom, compTo));
        }
    }

    // <Custom additional code> 
    private void Connect(GH_Document doc, IGH_Component compFrom, IGH_Param compTo)
    {
        if (compFrom == null || compTo == null) return;

        foreach (IGH_Param param in compFrom.Params.Output)
        {
            compTo.AddSource(param);
        }
    }
}
# ---------- end connect_mcp_tools_to_decall ----------
update_all_clusters = CSharpScript(update=button, recursive=toggle)  # -> out, A; inputs update: Boolean, recursive: Boolean, passwords: list of String, localPath: String
# ---------- update_all_clusters: C# ----------
using System;
using System.Collections;
using System.Collections.Generic;

using Rhino;
using Rhino.Geometry;

using Grasshopper;
using Grasshopper.Kernel;
using Grasshopper.Kernel.Data;
using Grasshopper.Kernel.Types;
using System.Windows.Forms;
using System.Linq;
/// <summary>
/// This class will be instantiated on demand by the Script component.
/// </summary>
public class Script_Instance : GH_ScriptInstance
{
  /// <summary>Print a String to the [Out] Parameter of the Script component.</summary>
  /// <param name="text">String to print.</param>
  private void Print(string text) { /* Implementation hidden. */ }
  /// <summary>Print a formatted String to the [Out] Parameter of the Script component.</summary>
  /// <param name="format">String format.</param>
  /// <param name="args">Formatting parameters.</param>
  private void Print(string format, params object[] args) { /* Implementation hidden. */ }
  /// <summary>Print useful information about an object instance to the [Out] Parameter of the Script component. </summary>
  /// <param name="obj">Object instance to parse.</param>
  private void Reflect(object obj) { /* Implementation hidden. */ }
  /// <summary>Print the signatures of all the overloads of a specific method to the [Out] Parameter of the Script component. </summary>
  /// <param name="obj">Object instance to parse.</param>
  private void Reflect(object obj, string method_name) { /* Implementation hidden. */ }

  /// <summary>Gets the current Rhino document.</summary>
  private readonly RhinoDoc RhinoDocument;
  /// <summary>Gets the Grasshopper document that owns this script.</summary>
  private readonly GH_Document GrasshopperDocument;
  /// <summary>Gets the Grasshopper script component that owns this script.</summary>
  private readonly IGH_Component Component;
  /// <summary>
  /// Gets the current iteration count. The first call to RunScript() is associated with Iteration==0.
  /// Any subsequent call within the same solution will increment the Iteration count.
  /// </summary>
  private readonly int Iteration;

  /// <summary>
  /// This procedure contains the user code. Input parameters are provided as regular arguments,
  /// Output parameters as ref arguments. You don't have to assign output parameters,
  /// they will have a default value.
  /// </summary>
  private void RunScript(
		bool update,
		bool recursive,
		List<string> passwords,
		string localPath,
		ref object A)
  {

    A = updateLog;
    if (update)
    {
      updateLog = new List<string>();
      _passwords = passwords;
      UpdateClusters(GrasshopperDocument, recursive, localPath);
    }

  }

  // <Custom additional code> 
  List<string> updateLog;
  List<String> _passwords;

  void UpdateClusters (GH_Document ghDoc, bool recursive, string localPath)
  {
    foreach (var obj in ghDoc.Objects)
    {
      var cluster = obj as Grasshopper.Kernel.Special.GH_Cluster;
      if (cluster != null)
      {
        var clusterPath = cluster.FilePath;
        if (!string.IsNullOrEmpty(clusterPath))
        {
          if (cluster.Synchronisation == Grasshopper.Kernel.Special.GH_Synchronisation.OutOfDate)
          {
            cluster.CreateFromFilePath(clusterPath);
            updateLog.Add("Updated: " + clusterPath);
          }
          else if (cluster.Synchronisation == Grasshopper.Kernel.Special.GH_Synchronisation.MissingReference)
          {
            string newPath = ReplacePath(localPath, clusterPath);
            if (!string.IsNullOrEmpty(newPath))
            {
              cluster.CreateFromFilePath(newPath);
              updateLog.Add("Replaced and updated: " + newPath);
            }
            else
            {
              updateLog.Add("Missing reference: " + clusterPath);
            }

          }
        }

        //Update recursively
        if (recursive)
        {
          GH_Document clusterDoc = GetClusterDoc(cluster);
          if (clusterDoc != null)
            UpdateClusters(clusterDoc, recursive, localPath);
        }
      }
    }
  }

  GH_Document GetClusterDoc(Grasshopper.Kernel.Special.GH_Cluster cluster)
  {
    //no pass needed
    var doc = cluster.Document(string.Empty);
    if (doc != null)
      return doc;

    //try passwords
    if (_passwords != null && _passwords.Any())
    {
      foreach (var pass in _passwords)
      {
        doc = cluster.Document(pass);
        if (doc != null)
          return doc;
      }
    }

    return null;
  }

  string ReplacePath(string localPath, string missingPath)
  {
    if (String.IsNullOrEmpty(missingPath) || string.IsNullOrEmpty(localPath))
      return null;
    else
    {
      string lastLocalPart = localPath.Split('\\').Last();
      string[] parts = missingPath.Split('\\');
      if (parts.Contains(lastLocalPart))
      {
        int i = Array.IndexOf(parts, lastLocalPart);
        string clusterPath = String.Join("\\", parts.Skip(i + 1));
        string result = String.Join("\\", localPath, clusterPath);
        return result;
      }
      else
        return null;
    }
  }
  // </Custom additional code> 
}
# ---------- end update_all_clusters ----------
panel = Panel(connect_mcp_tools_to_decall)

team_03_definition_cluster = Team03DefinitionCluster()
c_script = CSharpScript()  # -> out, availablePort
# ---------- c_script: C# ----------
// Grasshopper Script Instance
// This script finds an available port on the local machine.
#region Usings
using System;
using System.Linq;
using System.Collections;
using System.Collections.Generic;
using System.Drawing;
using System.Net;
using System.Net.Sockets;

using Rhino;
using Rhino.Geometry;

using Grasshopper;
using Grasshopper.Kernel;
using Grasshopper.Kernel.Data;
using Grasshopper.Kernel.Types;
#endregion

public class Script_Instance : GH_ScriptInstance
{
    #region Notes
    /* 
      Members:
        RhinoDoc RhinoDocument
        GH_Document GrasshopperDocument
        IGH_Component Component
        int Iteration

      Methods (Virtual & overridable):
        Print(string text)
        Print(string format, params object[] args)
        Reflect(object obj)
        Reflect(object obj, string method_name)
    */
    #endregion

    private void RunScript(object start, object end, ref object availablePort)
    {
        // Use default values if parameters are not provided
        int startPort = (start != null && int.TryParse(start.ToString(), out int s)) ? s : 3001;
        int endPort = (end != null && int.TryParse(end.ToString(), out int e)) ? e : 3100;

        // Find an available port in the specified range
        try
        {
            availablePort = FindAvailablePortInRange(startPort, endPort);
            Print($"Available port found: {availablePort}");
        }
        catch (Exception ex)
        {
            Print($"Error: {ex.Message}");
            availablePort = null;
        }
    }

    /// <summary>
    /// Checks if a local TCP port is available for binding (i.e., not in use).
    /// Returns True if available, False otherwise.
    /// </summary>
    private bool IsPortAvailableForBind(int port)
    {
        try
        {
            // Create a new TCP socket
            using (Socket socket = new Socket(AddressFamily.InterNetwork, SocketType.Stream, ProtocolType.Tcp))
            {
                // Try to bind to the port on all interfaces (0.0.0.0)
                socket.Bind(new IPEndPoint(IPAddress.Any, port));
                // If successful, the socket is closed by the using statement and return True
                return true;
            }
        }
        catch (SocketException)
        {
            // If binding fails, it means the port is already in use
            return false;
        }
    }

    /// <summary>
    /// Finds an available port by letting the OS assign one.
    /// </summary>
    private int FindAvailablePort()
    {
        Socket socket = new Socket(AddressFamily.InterNetwork, SocketType.Stream, ProtocolType.Tcp);
        socket.Bind(new IPEndPoint(IPAddress.Any, 0)); // Bind to an available port assigned by the OS
        int availablePort = ((IPEndPoint)socket.LocalEndPoint).Port; // Get the assigned port number
        socket.Close(); // Close the socket
        return availablePort;
    }

    /// <summary>
    /// Finds the first available port in a given range.
    /// </summary>
    private int FindAvailablePortInRange(int start = 3001, int end = 3100)
    {
        for (int port = start; port <= end; port++)
        {
            if (IsPortAvailableForBind(port))
                return port;
        }
        throw new Exception($"No available ports found in the range {start}-{end}.");
    }
}
# ---------- end c_script ----------
central_mcp_server = MCPServer(Port=c_script.availablePort, Tools=team_03_definition_cluster, ServerName="Swiftlet")  # -> Get_visibility, Collision_detector_sphere, Shortest_path, Check_door_widths, Widen_doors
panel_2 = Panel(c_script.availablePort)
get_tool_names = CSharpScript(x=team_03_definition_cluster)  # -> flatten(out)
# ---------- get_tool_names: C# ----------
// Grasshopper Script Instance
#region Usings
using System;
using System.Linq;
using System.Collections;
using System.Collections.Generic;
using System.Drawing;

using Rhino;
using Rhino.Geometry;

using Grasshopper;
using Grasshopper.Kernel;
using Grasshopper.Kernel.Data;
using Grasshopper.Kernel.Types;
#endregion

public class Script_Instance : GH_ScriptInstance
{
    #region Notes
    /* 
      Members:
        RhinoDoc RhinoDocument
        GH_Document GrasshopperDocument
        IGH_Component Component
        int Iteration

      Methods (Virtual & overridable):
        Print(string text)
        Print(string format, params object[] args)
        Reflect(object obj)
        Reflect(object obj, string method_name)
    */
    #endregion

    private void RunScript(object x)
    {
        dynamic dynamicX = x;
        Console.Write(dynamicX.Name);
    }
}
# ---------- end get_tool_names ----------
central_decall = Data([central_mcp_server.Widen_doors, central_mcp_server.Check_door_widths, central_mcp_server.Shortest_path, central_mcp_server.Collision_detector_sphere, central_mcp_server.Get_visibility])

# ---- group: ADD HERE YOUR RELATIVE PATH
# this script automates the extraction from the repo without the need of changing the code depending on the computer where it's located.
py3 = Python3Script(relative_path="../layout/layout_residential_complex.json")  # -> json_string, full_path, info; inputs relative_path: String
# ---------- py3: Python ----------
"""
GHPython component: Read a layout JSON file using a path relative to the .gh file.

No more hardcoded absolute paths — works on any computer that clones the repo.

INPUTS:
    relative_path  (str)  - Path relative to the .gh file folder.
                            Default: "../layout/layout_industrial_building.json"
                            Examples:
                              "../layout/layout_schema.json"
                              "../layout/layout_industrial_test-01.json"
                              "../../layout_input/layout_schema.json"

OUTPUTS:
    json_string  (str)  - The contents of the JSON file as a string.
    full_path    (str)  - The resolved absolute path (for debugging).
    info         (str)  - Status message.
"""

import os
import json

# ---- Default relative path (from gh/ folder to layout/ folder) ----
DEFAULT_REL = os.path.join("..", "layout", "layout_industrial_building.json")

# ---- Resolve input ----
try:
    rel = relative_path
    if rel is None or str(rel).strip() == "":
        rel = DEFAULT_REL
    else:
        rel = str(rel).strip()
except NameError:
    rel = DEFAULT_REL

# ---- Build absolute path from .gh file location ----
json_string = ""
full_path = ""
info = ""

try:
    gh_file = ghenv.Component.OnPingDocument().FilePath
    if gh_file is None or gh_file == "":
        info = "[ERROR] Save the .gh file first — Grasshopper needs a file path to resolve relative paths."
    else:
        gh_folder = os.path.dirname(gh_file)
        resolved = os.path.normpath(os.path.join(gh_folder, rel))
        full_path = resolved

        if not os.path.isfile(resolved):
            info = "[ERROR] File not found: {}".format(resolved)
        else:
            with open(resolved, "r") as f:
                text = f.read()
            # Validate that it's valid JSON
            json.loads(text)
            json_string = text
            info = "[OK] Loaded {} ({} chars)".format(os.path.basename(resolved), len(text))
except Exception as e:
    info = "[ERROR] {}".format(e)
# ---------- end py3 ----------

# ----
clean = CleanTree(RemoveNulls=True, RemoveInvalid=True, RemoveEmpty=False, Tree=central_decall)

# ---- group: Input Layout
json_file_path = FilePath(py3.full_path)
json2string = Python3Script(path=json_file_path)  # -> out, json_string; same code as json2string

# ---- group: Output Layout
json_file_path_2 = FilePath("C:\Users\jomig\repos\AIA26_Studio\team_01\team_01_edited_layout.json")
json2string_2 = Python3Script(path=json_file_path_2)  # -> out, json_string; same code as json2string

# ----
team_03_result_cluster = Team03ResultCluster(tool_call_request=clean)  # -> tool_names_3, tool_call_success

# ----
# Tool Names from the Results Clusters
# Tool Names from the Definition Clusters
# These Two Clusters should be EXACTLY THE SAME
panel_3 = Panel(get_tool_names)
panel_4 = Panel(team_03_result_cluster.tool_names_3)

# ---- group: 0 = Before, 1= After
number_slider = Slider(0, range=0..1)

# ----
# Visualize Layout from JSON: Before and After
panel_5 = Panel(json_file_path_2)
panel_6 = Panel(json_file_path)
filter = StreamFilter(Gate=number_slider, Stream0=json2string.json_string, Stream1=json2string_2.json_string)

rec = DataRecorder(team_03_result_cluster.tool_call_success, DataLimit=-10, RecordData=True)
rec_2 = DataRecorder(clean, DataLimit=-10, RecordData=True)

# ---- group: Request Parameters
decall = DeconstructToolCall(Request=clean)  # -> Request, Tool, Arguments
rjo = ReadJSONObject(JObject=decall.Arguments)  # -> Keys, JTokens
# Debug: Check request input data
panel_7 = Panel("room_name")
tmatch = MatchText(Text=rjo.Keys, Pattern=panel_7, Case=True)
tmatch_2 = MatchText(Text=rjo.Keys, Pattern="layout_json", Case=True)
dispatch = Dispatch(List=rjo.JTokens, DispatchPattern=tmatch)  # -> ListA, ListB
dispatch_2 = Dispatch(List=rjo.JTokens, DispatchPattern=tmatch_2)  # -> ListA, ListB
panel_8 = Panel(dispatch.ListA)
panel_9 = Panel(dispatch_2.ListA)

# ----
called_tool_name = Panel(rec_2)
response_ok = Panel(rec)

# ---- group: Extractor Tool do map json to grasshopper data
extractor = Python3Script(json_str=filter)  # -> out, outline_curve, room_names, room_curves, door_names, door_curves, window_names, window_curves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; same code as extractor

# ----
Z = UnitZ(Factor="2")
extr = Extrude(Base=extractor.door_curves, Direction=Z)

boundary = BoundarySurfaces(Edges=extractor.furniture_curves)
Z_2 = UnitZ(Factor=1)
unsplitextr = UnsplitExtrudeSurface(Profile=boundary, Direction=Z_2)
cap = CapHoles(Brep=unsplitextr)

Z_3 = UnitZ(Factor="1")
extr_2 = Extrude(Base=extractor.window_curves, Direction=Z_3)
move = Move(Geometry=extr_2, Motion=Z_3)  # -> Geometry, Transform

Z_4 = UnitZ(Factor="3")
extr_3 = Extrude(Base=extractor.structure_curves, Direction=Z_4)
sdiff = SolidDifference(BrepsA=extr_3, BrepsB=[move.Geometry, extr])

preview = CustomPreview(Geometry=extr, Material=ColourSwatch(SwatchColor=RGB(255, 255, 0)))

preview_2 = CustomPreview(Geometry=sdiff, Material=ColourSwatch(SwatchColor=RGBA(166, 166, 166, 200)))

preview_3 = CustomPreview(Geometry=move.Geometry, Material=ColourSwatch(SwatchColor=RGB(0, 255, 255)))

preview_4 = CustomPreview(Geometry=cap, Material=ColourSwatch(SwatchColor=RGB(100, 166, 93)))

# ---- group: Polylines
srf = Surface(extractor.room_curves)

# ---- group: Labels
area = Area(Geometry=srf)  # -> Area, Centroid
tag = TextTag(Location=area.Centroid, Text=extractor.room_names)

# ---- group: Polylines
lng = ListLength(List=srf)
range = Range(Domain=Domain(0, 1), Steps=lng)
gradient = Gradient(
    LowerLimit=0,
    UpperLimit=1,
    Parameter=range,
    stops=[0: RGB(48, 18, 59), 0.0294: RGB(56, 40, 112), 0.0588: RGB(63, 62, 156), 0.0882: RGB(68, 82, 193), 0.118: RGB(70, 102, 221), 0.147: RGB(71, 122, 241)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])

preview_5 = CustomPreview(Geometry=srf, Material=gradient)

# ----
# Debug Tool Names
# This Panel should always be TRUE
tool_names_from_the_results_clusters = Data(panel_4)
tool_names_from_the_definition_clusters = Data(panel_3)
join = TextJoin(Text=flatten(tool_names_from_the_definition_clusters))
join_2 = TextJoin(Text=flatten(tool_names_from_the_results_clusters))
tstat = TreeStatistics(Tree=tool_names_from_the_definition_clusters)  # -> Paths, Length, Count
tstat_2 = TreeStatistics(Tree=tool_names_from_the_results_clusters)  # -> Paths, Length, Count
dpath = DeconstructPath(Branch=tstat.Paths)
dpath_2 = DeconstructPath(Branch=tstat_2.Paths)
equals = Equality(FirstNumber=tstat.Length, SecondNumber=tstat_2.Length)  # -> Equality, Inequality
equals_2 = Equality(FirstNumber=tstat.Count, SecondNumber=tstat_2.Count)  # -> Equality, Inequality
ma = MassAddition(Input=flatten(equals.Equality))  # -> Result, PartialResults
equals_3 = Equality(FirstNumber=dpath, SecondNumber=dpath_2)  # -> Equality, Inequality
lng_2 = ListLength(List=equals.Equality)
ma_2 = MassAddition(Input=flatten(equals_3.Inequality))  # -> Result, PartialResults
equals_4 = Equality(FirstNumber=ma.Result, SecondNumber=lng_2)  # -> Equality, Inequality
does_quantity_of_tools_match = Panel(equals_2.Equality)
equals_5 = Equality(FirstNumber=ma_2.Result, SecondNumber="0")  # -> Equality, Inequality
does_quantity_of_tools_match_per_team = Panel(equals_4.Equality)
are_all_teams_included = Panel(equals_5.Equality)

tmatch_3 = MatchText(Text=join, Pattern=join_2, Case=True)

do_all_names_match = Panel(tmatch_3)
and = GateAnd(A=equals_5.Equality, B=equals_4.Equality, C=equals_2.Equality, D=tmatch_3)  # -> flatten(Result)
do_trees_match = Panel(and)

# ==== cluster Team03DefinitionCluster

panel = Panel("The Length of Any Side of the Base of a Square Pyramid")  # disabled
# Team 03 Definition Cluster
# SQUARE PYRAMID TEAM
panel_2 = Panel("The Length of Any Side of the Base of a Square Pyramid")  # disabled
panel_3 = Panel("The Height of a Square Pyramid")  # disabled
panel_4 = Panel("The Height of a Square Pyramid")  # disabled
panel_5 = Panel("This tool computes the area of a square pyramid by giving it the length of any side of the square base and the height of the point.  The output unit is the input unit squared.")  # disabled
panel_6 = Panel("This tool computes the volume of a square pyramid by giving it the length of any side of the square base and the height of the point.  The output unit is the input unit cubed.")  # disabled
panel_7 = Panel("This tool deletes a room by giving it a room name and the layout json")  # disabled
toggle = BooleanToggle(True)  # disabled
panel_8 = Panel("This tool deletes a room by giving it a room name and the layout json")  # disabled
toggle_2 = BooleanToggle(True)  # disabled
toggle_3 = BooleanToggle(True)  # disabled
toggle_4 = BooleanToggle(True)  # disabled
panel_9 = Panel("length")  # disabled
panel_10 = Panel("number")  # disabled
panel_11 = Panel("height")  # disabled
panel_12 = Panel("number")  # disabled
panel_13 = Panel("length")  # disabled
panel_14 = Panel("height")  # disabled
panel_15 = Panel("number")  # disabled
panel_16 = Panel("number")  # disabled
panel_17 = Panel("the name of the room")  # disabled
panel_18 = Panel("the layout data structure")  # disabled
panel_19 = Panel("the name of the room")  # disabled
panel_20 = Panel("the layout data structure")  # disabled
panel_21 = Panel("The width of the window")  # disabled
panel_22 = Panel("room_name")  # disabled
toggle_5 = BooleanToggle(True)  # disabled
panel_23 = Panel("layout_json")  # disabled
panel_24 = Panel("room_name")  # disabled
toggle_6 = BooleanToggle(True)  # disabled
toggle_7 = BooleanToggle(True)  # disabled
panel_25 = Panel("layout_json")  # disabled
toggle_8 = BooleanToggle(True)  # disabled
panel_26 = Panel("width")  # disabled
toggle_9 = BooleanToggle(True)  # disabled
panel_27 = Panel("compute_area_of_square_pyramid")  # disabled
panel_28 = Panel("compute_volume_of_square_pyramid")  # disabled
panel_29 = Panel("string")  # disabled
panel_30 = Panel("string")  # disabled
panel_31 = Panel("string")  # disabled
panel_32 = Panel("string")  # disabled
panel_33 = Panel("number")  # disabled
param = DefineToolParameter(Name=panel_11, Type=panel_12, Description=panel_3, Required=toggle)  # disabled
param_2 = DefineToolParameter(Name=panel_9, Type=panel_10, Description=panel, Required=toggle_2)  # disabled
param_3 = DefineToolParameter(Name=panel_14, Type=panel_16, Description=panel_4, Required=toggle_3)  # disabled
param_4 = DefineToolParameter(Name=panel_13, Type=panel_15, Description=panel_2, Required=toggle_4)  # disabled
panel_34 = Panel("delete_room_03")  # disabled
panel_35 = Panel("add_window_03")  # disabled
param_5 = DefineToolParameter(Name=panel_22, Type=panel_29, Description=panel_17, Required=toggle_5)  # disabled
merge = Merge(Data1=param_2, Data2=param)  # disabled
merge_2 = Merge(Data1=param_4, Data2=param_3)  # disabled
param_6 = DefineToolParameter(Name=panel_23, Type=panel_30, Description=panel_18, Required=toggle_6)  # disabled
param_7 = DefineToolParameter(Name=panel_24, Type=panel_31, Description=panel_19, Required=toggle_7)  # disabled
param_8 = DefineToolParameter(Name=panel_25, Type=panel_32, Description=panel_20, Required=toggle_8)  # disabled
param_9 = DefineToolParameter(Name=panel_26, Type=panel_33, Description=panel_21, Required=toggle_9)  # disabled
merge_3 = Merge(Data1=param_5, Data2=param_6)  # disabled
merge_4 = Merge(Data1=param_7, Data2=param_9, Data3=param_8)  # disabled
tool = DefineTool(Name=panel_27, Description=panel_5, Parameters=merge)  # disabled
tool_2 = DefineTool(Name=panel_28, Description=panel_6, Parameters=merge_2)  # disabled
tool_3 = DefineTool(Name=panel_34, Description=panel_7, Parameters=merge_3)  # disabled
tool_4 = DefineTool(Name=panel_35, Description=panel_8, Parameters=merge_4)  # disabled

# ----
# Ramy
panel_36 = Panel("Use this tool to analyze what rooms are visible from a given room in the apartment floor plan. Input the room name (corridor, kitchen, living, dining, bedroom1, bedroom2, wc1, wc2, wc3) to get visibility percentages.")
param_10 = DefineToolParameter(Name="room_name", Type="string", Description="the name of the room to analyze visibility from", Required=Toggle(True))
param_11 = DefineToolParameter(Name="radius", Type="number", Description="the viewing radius in meters", Required=Toggle(True))
merge_5 = Merge(Data1=param_10, Data2=param_11)
tool_5 = DefineTool(Name="get_visibility", Description=panel_36, Parameters=merge_5)

# ----
# Ramon
panel_37 = Panel("location of a point in a normalized polyline lenght, values form 0.00 to 1.00")
panel_38 = Panel("the destination point of the layout, can be a list of destinations")
panel_39 = Panel("""This tool evaluates physical passability along a circulation path by simulating a 2D circle (representing a user's clearance radius, e.g. a wheelchair) traveling along a polyline divided into segments.

  How it works:

  1. The circle moves along the full polyline (domain 0–1), testing for collisions with walls and obstacles at each position.
  2. When a collision is detected, the tool iteratively reduces the circle's radius until the collision is resolved or the minimum allowable radius is reached.
  3. When no collision is detected, the radius is expanded back toward its maximum (the user profile's required clearance).
  4. If reducing the radius to its absolute minimum still results in a collision, the tool flags that segment as impassable — indicating a physical obstruction that cannot be resolved by the current geometry.

  Output includes:
  - The path from start room to destination room (polyline through door positions)
  - Number of doors crossed
  - Per-segment collision status (pass/fail)
  - The effective radius at each segment (indicating how much clearance is available)
  - Flagged segments where the path is inaccessible regardless of radius reduction""")
panel_40 = Panel("the entry point of the layout, typically the entrance or foyer")
param_12 = DefineToolParameter(Name="start_room_collision", Type="string", Description=panel_40, Required=Toggle(True))
param_13 = DefineToolParameter(Name="destination_room_collision", Type="string", Description=panel_38, Required=Toggle(True))
param_14 = DefineToolParameter(Name="sphere_radius_list", Type="number", Description="radius of the sphere", Required=Toggle(True))
param_15 = DefineToolParameter(Name="point_in_path", Type="number", Description=panel_37, Required=Toggle(True))
merge_6 = Merge(Data1=param_14, Data2=param_15, Data3=param_13, Data4=param_12)
tool_6 = DefineTool(Name="collision_detector_sphere", Description=panel_39, Parameters=merge_6)

# ----
# Hani
panel_41 = Panel("Simulates the shortest path from a start room to all rooms and scores each door position")
panel_42 = Panel("the entry point of the layout, typically the entrance or foyer")
param_16 = DefineToolParameter(Name="start_room", Type="string", Description=panel_42, Required=Toggle(True))
param_17 = DefineToolParameter(Name="destination_room", Type="string", Description="the layout data structure", Required=Toggle(True))
merge_7 = Merge(Data1=param_16, Data2=param_17)
tool_7 = DefineTool(Name="shortest_path", Description=panel_41, Parameters=merge_7)

# ----
# Hani
panel_43 = Panel("Checks if all doors in the layout meet the minimum width requirement for the active user profile. Flags doors that are too narrow and returns a conflict summary")
panel_44 = Panel("minimum door width required for the user profile in meters, e.g. 0.9 for wheelchair")
param_18 = DefineToolParameter(Name="min_door_width", Type="number", Description=panel_44, Required=Toggle(True))
tool_8 = DefineTool(Name="check_door_widths", Description=panel_43, Parameters=param_18)

# ----
# Hani
panel_45 = Panel("Widens all doors that are too narrow to meet the minimum width requirement. Moves the door geometry in Rhino and returns updated layout JSON")
panel_46 = Panel("Minimum required width in meters (e.g., 0.9 for wheelchair).")
panel_47 = Panel("Comma-separated door IDs from check_door_widths, e.g. \"d03,d04,d09,d10\"")
param_19 = DefineToolParameter(Name="target_width", Type="number", Description=panel_46, Required=Toggle(True))
param_20 = DefineToolParameter(Name="door_ids", Type="string", Description=panel_47, Required=Toggle(True))
merge_8 = Merge(Data1=param_19, Data2=param_20)
tool_9 = DefineTool(Name="widen_doors", Description=panel_45, Parameters=merge_8)

# ----
# Hani
panel_48 = Panel("This tool simulates agent movement through a residential layout and scores rooms for circulation quality, bottlenecks, and flow efficiency")
panel_49 = Panel("the entry point of the layout, typically the entrance or foyer")
param_21 = DefineToolParameter(Name="start_room", Type="string", Description=panel_49, Required=Toggle(True))
param_22 = DefineToolParameter(Name="layout_json", Type="string", Description="the layout data structure", Required=Toggle(True))
merge_9 = Merge(Data1=param_21, Data2=param_22)
tool_10 = DefineTool(Name="simulate_circulation", Description=panel_48, Parameters=merge_9)

merge_10 = Merge(
    Data1=tool_2,
    Data2=tool,
    Data3=tool_3,
    Data4=tool_4,
    Data5=tool_5,
    Data6=tool_6,
    Data7=tool_7,
    Data8=tool_8,
    Data9=tool_9)
mcp_tool_list = ClusterOutput(merge_10)

# ==== cluster Team03ResultCluster
# Team 03 Result Cluster
# SQUARE PYRAMID TEAM
# Edit Tool Names to
# Match Definition Cluster
tool_names = Panel("""get_visibility
collision_detector_sphere
shortest_path
check_door_widths
widen_doors""")

# ----
# Sorting Logic, Please Do Not Edit
tool_call_request = ClusterInput()
tool_names_2 = Text(tool_names)
decall = DeconstructToolCall(Request=tool_call_request)  # -> Request, Tool, Arguments
mindex = MemberIndex(Set=tool_names, Member=decall.Tool)  # -> Index, Count
sift = SiftPattern(List=decall.Request, SiftPattern=mindex.Index)  # -> Output0, Output1, Output2, Output3, Output4

# ---- group: Cluster Output
tool_names_3 = ClusterOutput(tool_names_2)

# ----
panel = Panel("https://raw.githubusercontent.com/sclebow/AIA26_Studio/refs/heads/team_03/team_03/layout/layout_schema.json")
refresh = Button()
py3 = Python3Script(url=panel, refresh=refresh)  # -> out, doors, door_ids, rooms, room_ids, room_names, start_room, raw_json, a; inputs url: String, refresh: Boolean
# ---------- py3: Python ----------
import json
import Rhino.Geometry as rg

try:
    import urllib2
    def fetch(url):
        req = urllib2.Request(url, headers={"Cache-Control": "no-cache"})
        return urllib2.urlopen(req).read()
except ImportError:
    import urllib.request
    def fetch(url):
        req = urllib.request.Request(url, headers={"Cache-Control": "no-cache"})
        return urllib.request.urlopen(req).read().decode("utf-8")

# INPUTS:
#   url     -> str  (Item Access)
#   refresh -> bool (Item Access)  Button para forzar re-descarga
#
# OUTPUTS:
#   doors      -> LineCurve
#   door_ids   -> str
#   rooms      -> PolylineCurve (cerradas)
#   room_ids   -> str
#   room_names -> str  (corridor, kitchen, living, etc.)
#   start_room -> str
#   raw_json   -> str
#   a          -> str (estado)

try:
    raw = fetch(url)
    if isinstance(raw, bytes):
        raw = raw.decode("utf-8")
    data = json.loads(raw)
    raw_json = raw

    # Puertas
    doors = []
    door_ids = []
    for door in data.get("doors", []):
        sp = rg.Point3d(door["start"][0], door["start"][1], 0)
        ep = rg.Point3d(door["end"][0],   door["end"][1],   0)
        doors.append(rg.LineCurve(sp, ep))
        door_ids.append(door.get("id", ""))

    # Habitaciones (clave 'geometry')
    rooms = []
    room_ids = []
    room_names = []
    for room in data.get("rooms", []):
        geom = room.get("geometry", [])
        if not geom:
            continue
        pts = [rg.Point3d(p[0], p[1], 0) for p in geom]
        if pts[0].DistanceTo(pts[-1]) > 1e-6:
            pts.append(pts[0])
        rooms.append(rg.PolylineCurve(pts))
        room_ids.append(room.get("id", ""))
        room_names.append(room.get("name", ""))

    start_room = data.get("start_room", "")
    a = "OK: {} puertas, {} rooms descargados.".format(len(doors), len(rooms))

except Exception as e:
    doors, door_ids, rooms, room_ids, room_names = [], [], [], [], []
    start_room, raw_json = "", ""
    a = "ERROR: {}".format(str(e))
# ---------- end py3 ----------

decall_2 = DeconstructToolCall(Request=sift.Output1)  # -> Request, Tool, Arguments
gjok = GetJSONObjectKey(JObject=decall_2.Arguments, Key="point_in_path")
gjok_2 = GetJSONObjectKey(JObject=decall_2.Arguments, Key="sphere_radius_list")
rjv = ReadJSONValue(JValue=gjok)  # -> AsString, AsNumber, AsBool
rjv_2 = ReadJSONValue(JValue=gjok_2)  # -> AsString, AsNumber, AsBool

gjok_3 = GetJSONObjectKey(JObject=decall_2.Arguments, Key="destination_room_collision")
rjv_3 = ReadJSONValue(JValue=gjok_3)  # -> AsString, AsNumber, AsBool

deconstruct_tool_call = DeconstructToolCall(Request=sift.Output4)  # -> Request, Tool, Arguments

gjok_4 = GetJSONObjectKey(JObject=decall_2.Arguments, Key="start_room_collision")
rjv_4 = ReadJSONValue(JValue=gjok_4)  # -> AsString, AsNumber, AsBool

# ---- group: Get the request sent from VSC Agent
decall_3 = DeconstructToolCall()  # -> Request, Tool, Arguments; disabled

# ----
decall_4 = DeconstructToolCall()  # -> Request, Tool, Arguments; disabled
panel_2 = Panel("length")  # disabled
panel_3 = Panel("height")  # disabled
gjok_5 = GetJSONObjectKey(JObject=decall_4.Arguments, Key=panel_3)  # disabled
gjok_6 = GetJSONObjectKey(JObject=decall_4.Arguments, Key=panel_2)  # disabled
rjv_5 = ReadJSONValue(JValue=gjok_6)  # -> AsString, AsNumber, AsBool; disabled
rjv_6 = ReadJSONValue(JValue=gjok_5)  # -> AsString, AsNumber, AsBool; disabled
rectangle = Rectangle(Plane=PlaneXY(0, 0, 0), XSize=rjv_5.AsNumber, YSize=rjv_5.AsNumber, Radius=0)  # -> Rectangle, Length; disabled
pcen = PolygonCenter(Polyline=rectangle.Rectangle)  # -> CenterV, CenterE, CenterA; disabled
Z = UnitZ(Factor=rjv_6.AsNumber)  # disabled
avr = Average(Input=pcen.CenterV)  # disabled
move = Move(Geometry=avr, Motion=Z)  # -> Geometry, Transform; disabled
extr = ExtrudePoint(Base=rectangle.Rectangle, Point=move.Geometry)  # disabled
cap = CapHoles(Brep=extr)  # disabled
volume = Volume(Geometry=cap)  # -> Volume, Centroid; disabled

decall_5 = DeconstructToolCall()  # -> Request, Tool, Arguments; disabled
panel_4 = Panel("height")  # disabled
panel_5 = Panel("length")  # disabled
gjok_7 = GetJSONObjectKey(JObject=decall_5.Arguments, Key=panel_4)  # disabled
gjok_8 = GetJSONObjectKey(JObject=decall_5.Arguments, Key=panel_5)  # disabled
rjv_7 = ReadJSONValue(JValue=gjok_7)  # -> AsString, AsNumber, AsBool; disabled
rjv_8 = ReadJSONValue(JValue=gjok_8)  # -> AsString, AsNumber, AsBool; disabled
rectangle_2 = Rectangle(Plane=PlaneXY(0, 0, 0), XSize=rjv_8.AsNumber, YSize=rjv_8.AsNumber, Radius=0)  # -> Rectangle, Length; disabled
pcen_2 = PolygonCenter(Polyline=rectangle_2.Rectangle)  # -> CenterV, CenterE, CenterA; disabled
Z_2 = UnitZ(Factor=rjv_7.AsNumber)  # disabled
avr_2 = Average(Input=pcen_2.CenterV)  # disabled
move_2 = Move(Geometry=avr_2, Motion=Z_2)  # -> Geometry, Transform; disabled
extr_2 = ExtrudePoint(Base=rectangle_2.Rectangle, Point=move_2.Geometry)  # disabled
cap_2 = CapHoles(Brep=extr_2)  # disabled
area = Area(Geometry=cap_2)  # -> Area, Centroid; disabled

py3_2 = Python3Script(door_ids=deconstruct_tool_call.Arguments, layout_str=py3.raw_json)  # -> a, new_lines, new_ids, all_lines, msg; inputs target_width: Double
# ---------- py3_2: Python ----------
import json
import Rhino.Geometry as rg

# INPUTS:
#   layout_str    -> str (Item Access)  JSON completo del layout (del downloader/local)
#   door_ids      -> str (Item Access)  IDs de puertas a ensanchar (CSV, JSON array, o JSON completo del LLM)
#   target_width  -> float (Item Access) ancho objetivo en metros (default 0.9)
#
# OUTPUTS:
#   a             -> JSON string con resultado para el LLM
#   new_lines     -> Lines de las puertas modificadas (para visualizacion/updater)
#   new_ids       -> IDs de las puertas modificadas (paralelo a new_lines)
#   all_lines     -> Todas las puertas (modificadas + originales) para preview
#   msg           -> diagnostico

a = ""
new_lines = []
new_ids = []
all_lines = []
msg = ""

try:
    # ===== 0) DETECTAR SI door_ids ES UN JSON WRAPPER COMPLETO =====
    # El LLM puede mandar {"door_ids": "...", "target_width": ...} en un solo campo
    if door_ids:
        raw_check = str(door_ids).strip()
        if raw_check.startswith("{"):
            try:
                obj = json.loads(raw_check)
                if isinstance(obj, dict):
                    # Si trae target_width adentro y el input target_width esta vacio, usarlo
                    if "target_width" in obj and (target_width is None):
                        target_width = obj["target_width"]
                    # Reemplazar door_ids con el valor interno
                    for key in ("door_ids", "ids", "doors"):
                        if key in obj:
                            inner = obj[key]
                            if isinstance(inner, list):
                                door_ids = ",".join(str(x) for x in inner)
                            else:
                                door_ids = str(inner)
                            break
            except:
                pass

    # ===== 1) PARSEAR door_ids =====
    ids_list = []
    if door_ids:
        raw = str(door_ids).strip()

        # JSON array "[\"d03\",\"d04\"]"
        if raw.startswith("["):
            try:
                parsed = json.loads(raw)
                if isinstance(parsed, list):
                    ids_list = [str(x).strip().strip('"').strip("'") for x in parsed]
            except:
                pass

        # CSV "d03,d04,d09,d10"
        if not ids_list and "," in raw:
            ids_list = [s.strip().strip('"').strip("'") for s in raw.split(",") if s.strip()]

        # Un solo ID "d03"
        if not ids_list:
            single = raw.strip().strip('"').strip("'")
            if single and not single.startswith("{") and not single.startswith("["):
                ids_list = [single]

    # ===== 2) RESOLVER target_width =====
    try:
        tw = float(target_width) if target_width is not None else 0.9
    except:
        tw = 0.9

    if tw <= 0:
        tw = 0.9

    # ===== 3) CARGAR LAYOUT =====
    layout = json.loads(str(layout_str))
    doors = layout.get("doors", [])

    # ===== 4) MODIFICAR PUERTAS =====
    modified = []
    skipped_already_wide = []
    not_found = list(ids_list)

    for door in doors:
        did = door.get("id")
        start = door.get("start")
        end = door.get("end")
        if not start or not end:
            continue

        sp = rg.Point3d(start[0], start[1], 0)
        ep = rg.Point3d(end[0],   end[1],   0)
        original_line = rg.Line(sp, ep)

        if did in ids_list:
            if did in not_found:
                not_found.remove(did)

            current_width = original_line.Length

            if current_width >= tw - 1e-6:
                skipped_already_wide.append(did)
                all_lines.append(rg.LineCurve(original_line))
                continue

            mid_x = (sp.X + ep.X) * 0.5
            mid_y = (sp.Y + ep.Y) * 0.5

            dx = ep.X - sp.X
            dy = ep.Y - sp.Y

            if abs(dx) >= abs(dy):
                half = tw / 2.0
                new_sp = rg.Point3d(mid_x - half, mid_y, 0)
                new_ep = rg.Point3d(mid_x + half, mid_y, 0)
            else:
                half = tw / 2.0
                new_sp = rg.Point3d(mid_x, mid_y - half, 0)
                new_ep = rg.Point3d(mid_x, mid_y + half, 0)

            new_line = rg.Line(new_sp, new_ep)
            new_lines.append(new_line)
            new_ids.append(did)
            all_lines.append(rg.LineCurve(new_line))
            modified.append(did)

        else:
            all_lines.append(rg.LineCurve(original_line))

    # ===== 5) OUTPUT COMPACTO PARA EL LLM =====
    result = {
        "modified": modified,
        "target_width": tw,
        "status": "ok" if modified else ("nothing_to_widen" if not ids_list else "no_match")
    }
    if skipped_already_wide:
        result["already_wide"] = skipped_already_wide
    if not_found:
        result["not_found"] = not_found

    a = json.dumps(result)

    msg = "ids_received={!r} | parsed={} | target_width={} | modified={} | skipped={} | not_found={}".format(
        str(door_ids)[:120], ids_list, tw, modified, skipped_already_wide, not_found
    )

except Exception as ex:
    a = json.dumps({"error": str(ex)})
    msg = "ERROR: {} | door_ids={!r} | target_width={!r}".format(
        str(ex), str(door_ids)[:120], str(target_width)[:40]
    )
# ---------- end py3_2 ----------
panel_6 = Panel(py3_2.a)
panel_7 = Panel(py3_2.msg)
parse_json_string = ParseJSONString(Text=py3_2.a)
mcp_tool_response = MCPToolResponse(Request=deconstruct_tool_call.Request, Content=parse_json_string, IsError=False)

decall_6 = DeconstructToolCall(Request=sift.Output0)  # -> Request, Tool, Arguments
gjok_9 = GetJSONObjectKey(JObject=decall_6.Arguments, Key="room_name")
gjok_10 = GetJSONObjectKey(JObject=decall_6.Arguments, Key="radius")
rjv_9 = ReadJSONValue(JValue=gjok_10)  # -> AsString, AsNumber, AsBool
rjv_10 = ReadJSONValue(JValue=gjok_9)  # -> AsString, AsNumber, AsBool

# ---- group: Extract the tool call parameters
panel_8 = Panel("layout_json")  # disabled
panel_9 = Panel("room_name")  # disabled
panel_10 = Panel("width")  # disabled
gjok_11 = GetJSONObjectKey(JObject=decall_3.Arguments, Key=panel_8)  # disabled
gjok_12 = GetJSONObjectKey(JObject=decall_3.Arguments, Key=panel_9)  # disabled
gjok_13 = GetJSONObjectKey(JObject=decall_3.Arguments, Key=panel_10)  # disabled
rjv_11 = ReadJSONValue(JValue=gjok_11)  # -> AsString, AsNumber, AsBool; disabled

# ----
py3_3 = Python3Script(layout_json=rjv_10.AsString, room_filter=rjv_3.AsString)  # -> out, rooms, ids, info; inputs layout_json: String, room_filter: String
# ---------- py3_3: Python ----------
"""
GHPython component: Extract destination room name(s) from layout_json.

Reads the rooms list from a layout JSON string and outputs either:
  - one specific room (when `room_filter` matches a room name or id), OR
  - all rooms (when `room_filter` is empty / None / "all" / "*").

INPUTS:
    layout_json  (str)  - The layout JSON string. If empty/invalid,
                          falls back to layout_input/layout_schema.json on disk.
    room_filter  (str)  - Optional. Name or id of a single room to extract.
                          Leave empty (or use "all" / "*") to return every room.

OUTPUTS:
    rooms  (list)  - List of room names matching the filter (all rooms if none).
    ids    (list)  - Corresponding room ids, in the same order as `rooms`.
    info   (str)   - Status / debug message.
"""

import json

LAYOUT_FILE_FALLBACK = r"C:\IAAC Repositories 2026\AIA26_Studio\layout_input\layout_schema.json"


def _coerce_to_string(value):
    """Accept str, list of str, or anything stringifiable; join lists with newlines."""
    if value is None:
        return None
    if isinstance(value, str):
        return value
    try:
        return "\n".join(str(v) for v in value)
    except TypeError:
        return str(value)


def _load_layout_text(wired_value):
    """Return a valid layout JSON string from the wire, or from disk as fallback."""
    try:
        candidate = _coerce_to_string(wired_value)
        if candidate and candidate.strip():
            json.loads(candidate)
            return candidate, "wire"
    except Exception:
        pass
    try:
        with open(LAYOUT_FILE_FALLBACK, "r") as f:
            text = f.read()
        json.loads(text)
        return text, "disk fallback"
    except Exception:
        return None, None


# ---------- Outputs ----------
rooms = []
ids = []
info = ""

# Resolve room_filter (treat missing input as "all")
try:
    _ = room_filter
    if room_filter is None:
        filter_value = ""
    else:
        filter_value = str(room_filter).strip()
except NameError:
    filter_value = ""

want_all = filter_value == "" or filter_value.lower() in ("all", "*")

# Load layout
layout_text, source = _load_layout_text(layout_json if "layout_json" in dir() else None)
if layout_text is None:
    info = "[ERROR] Could not load layout_json (wire empty/invalid AND disk fallback failed)"
else:
    try:
        layout = json.loads(layout_text)
        room_list = layout.get("rooms", [])
        if not isinstance(room_list, list) or len(room_list) == 0:
            info = "[ERROR] Layout has no 'rooms' list"
        elif want_all:
            for r in room_list:
                rooms.append(r.get("name", ""))
                ids.append(r.get("id", ""))
            info = "[OK] Returning ALL rooms ({}) | source: {}".format(len(rooms), source)
        else:
            target = filter_value.lower()
            matched = None
            for r in room_list:
                name = str(r.get("name", "")).lower()
                rid = str(r.get("id", "")).lower()
                if name == target or rid == target:
                    matched = r
                    break
            if matched is None:
                available = [r.get("name", "?") for r in room_list]
                info = "[NO MATCH] Room '{}' not found. Available: {} | source: {}".format(
                    filter_value, ", ".join(available), source
                )
            else:
                rooms.append(matched.get("name", ""))
                ids.append(matched.get("id", ""))
                info = "[OK] Returning room '{}' (id={}) | source: {}".format(
                    rooms[0], ids[0], source
                )
    except Exception as e:
        info = "[ERROR] Failed to parse layout: {}".format(e)
# ---------- end py3_3 ----------

py3_4 = Python3Script(
    start_room=rjv_4.AsString,
    target_room=py3_3.rooms,
    layout_json=rjv_10.AsString,
    show_preview=Toggle(False),
    reset=Button())  # -> out, polyline, points, info; inputs start_room: String, target_room: String, layout_json: String, show_preview: Boolean, reset: Boolean
# ---------- py3_4: Python ----------
"""
GHPython component: Computes shortest path through doors and draws it in the
Rhino viewport. Self-contained — does NOT depend on shortest_path output.

INPUTS:
    layout_json  (str)   - Layout JSON string. Falls back to disk file if empty.
    target_room  (str)   - Destination room name (e.g. "bedroom1").
    start_room   (str)   - Origin room name. If empty, uses layout's "start_room".
    show_preview (bool)  - Toggle the live viewport overlay (default True).
    reset        (bool)  - Button to clear viewport overlay AND outputs.

OUTPUTS:
    polyline  (PolylineCurve) - Path through door positions.
    points    (list)          - Individual points along the path.
    info      (str)           - Description / debug status.
"""

import json
from collections import deque
import scriptcontext as sc
import Rhino
import Rhino.Geometry as rg
from System.Drawing import Color


LAYOUT_FILE_FALLBACK = r"C:\IAAC Repositories 2026\AIA26_Studio\layout_input\layout_schema.json"
STICKY_KEY = "team_03_path_ramon_display"


# ---------- Overlay cleanup (siempre limpia el preview anterior) ----------
prev = sc.sticky.get(STICKY_KEY)
if prev is not None:
    try:
        prev.Dispose()
    except Exception:
        pass
    sc.sticky[STICKY_KEY] = None

# Default toggles
try:
    _ = show_preview
    if show_preview is None:
        show_preview = True
except NameError:
    show_preview = True

try:
    _ = reset
    if reset is None:
        reset = False
except NameError:
    reset = False


# ========================================
# MODO RESET: si se activo, limpiar todo
# ========================================
if reset:
    polyline = None
    points = []
    info = "[RESET] Outputs cleared. Viewport overlay removed."
    try:
        Rhino.RhinoDoc.ActiveDoc.Views.Redraw()
    except Exception:
        pass

else:
    # ========================================
    # MODO NORMAL: calcular y dibujar path
    # ========================================

    # ---------- Helpers ----------
    def _coerce_to_string(value):
        if value is None:
            return None
        if isinstance(value, str):
            return value
        try:
            return "\n".join(str(v) for v in value)
        except TypeError:
            return str(value)


    def _load_layout_text(wired_value):
        try:
            candidate = _coerce_to_string(wired_value)
            if candidate and candidate.strip():
                json.loads(candidate)
                return candidate, "wire"
        except Exception:
            pass
        try:
            with open(LAYOUT_FILE_FALLBACK, "r") as f:
                text = f.read()
            json.loads(text)
            return text, "disk fallback"
        except Exception:
            return None, None


    def _room_id_by_name(layout, name):
        for r in layout.get("rooms", []):
            if r.get("name") == name or r.get("id") == name:
                return r.get("id")
        return None


    def _room_name_by_id(layout, rid):
        for r in layout.get("rooms", []):
            if r.get("id") == rid:
                return r.get("name", rid)
        return rid


    def _build_graph(layout):
        graph = {}
        for r in layout.get("rooms", []):
            graph[r["id"]] = []
        for d in layout.get("doors", []):
            c = d.get("connects", [])
            if len(c) != 2:
                continue
            r1, r2 = c
            if r1 not in graph or r2 not in graph:
                continue
            graph[r1].append({"room": r2, "door": d["id"], "position": d["position"]})
            graph[r2].append({"room": r1, "door": d["id"], "position": d["position"]})
        return graph


    def _bfs_path(graph, start_id, target_id):
        if start_id == target_id:
            return []
        visited = {start_id}
        parents = {start_id: (None, None)}
        queue = deque([start_id])
        while queue:
            cur = queue.popleft()
            for nb in graph.get(cur, []):
                if nb["room"] in visited:
                    continue
                visited.add(nb["room"])
                parents[nb["room"]] = (cur, nb["door"])
                if nb["room"] == target_id:
                    doors = []
                    node = target_id
                    while parents[node][0] is not None:
                        doors.append(parents[node][1])
                        node = parents[node][0]
                    doors.reverse()
                    return doors
                queue.append(nb["room"])
        return None


    def _room_centroid(layout, room_name):
        for r in layout.get("rooms", []):
            if r.get("name") == room_name or r.get("id") == room_name:
                geom = r.get("geometry")
                if geom and len(geom) > 0:
                    xs = [p[0] for p in geom]
                    ys = [p[1] for p in geom]
                    return [sum(xs) / len(xs), sum(ys) / len(ys)]
        rid = _room_id_by_name(layout, room_name)
        if rid:
            connected = [d["position"] for d in layout.get("doors", []) if rid in d.get("connects", [])]
            if connected:
                ax = sum(p[0] for p in connected) / len(connected)
                ay = sum(p[1] for p in connected) / len(connected)
                return [ax, ay]
        return None


    def draw_overlay(pts):
        try:
            disp = Rhino.Display.CustomDisplay(True)
        except Exception as e:
            return "CustomDisplay constructor failed: {}".format(e)

        line_color = Color.FromArgb(255, 80, 220, 120)
        pt_color = Color.FromArgb(255, 255, 220, 0)

        try:
            if len(pts) >= 2:
                pl_curve = rg.Polyline(pts).ToPolylineCurve()
                try:
                    disp.AddCurve(pl_curve, line_color, 5)
                except Exception:
                    for i in range(len(pts) - 1):
                        disp.AddLine(rg.Line(pts[i], pts[i + 1]), line_color, 5)
        except Exception as e:
            return "polyline draw failed: {}".format(e)

        try:
            for p in pts:
                disp.AddPoint(p, pt_color)
        except Exception as e:
            return "AddPoint failed: {}".format(e)

        try:
            xs = [p.X for p in pts]
            ys = [p.Y for p in pts]
            diag = ((max(xs) - min(xs)) ** 2 + (max(ys) - min(ys)) ** 2) ** 0.5
            label_size = max(diag * 0.03, 0.15)
            offset = label_size * 0.6
            text_color = Color.White

            for i, p in enumerate(pts):
                origin = rg.Point3d(p.X + offset, p.Y + offset, p.Z)
                plane = rg.Plane(origin, rg.Vector3d.ZAxis)
                label = "{}".format(i)
                drawn = False
                try:
                    t3d = Rhino.Display.Text3d(label, plane, label_size)
                    disp.AddText(t3d, text_color)
                    drawn = True
                except Exception:
                    pass
                if not drawn:
                    try:
                        disp.AddText(label, plane, label_size, "Arial", False, False, text_color)
                        drawn = True
                    except Exception:
                        pass
        except Exception:
            pass

        sc.sticky[STICKY_KEY] = disp
        try:
            Rhino.RhinoDoc.ActiveDoc.Views.Redraw()
        except Exception as e:
            return "Views.Redraw failed: {}".format(e)
        return None


    # ---------- Outputs ----------
    polyline = None
    points = []
    info = ""

    # Inputs
    try:
        _layout_wired = layout_json
    except NameError:
        _layout_wired = None
    try:
        _target = target_room
    except NameError:
        _target = None
    try:
        _start_in = start_room
    except NameError:
        _start_in = None

    if not _target:
        info = "[WAITING] Missing input: target_room"
    else:
        layout_text, source = _load_layout_text(_layout_wired)
        if layout_text is None:
            info = "[ERROR] Could not load layout_json (wire empty AND disk fallback failed)"
        else:
            try:
                layout = json.loads(layout_text)
            except Exception as e:
                layout = None
                info = "[ERROR] Invalid layout_json: {}".format(e)

            if layout is not None:
                start_name = _start_in if _start_in else layout.get("start_room")
                if not start_name:
                    info = "[ERROR] No start_room provided and layout has no 'start_room' field"
                else:
                    start_id = _room_id_by_name(layout, start_name)
                    target_id = _room_id_by_name(layout, _target)
                    if start_id is None:
                        info = "[NO MATCH] start_room '{}' not in layout".format(start_name)
                    elif target_id is None:
                        available = [r.get("name") for r in layout.get("rooms", [])]
                        info = "[NO MATCH] target_room '{}' not in layout. Available: {}".format(
                            _target, ", ".join(available)
                        )
                    else:
                        path_doors = _bfs_path(_build_graph(layout), start_id, target_id)
                        if path_doors is None:
                            info = "[ERROR] No path from '{}' to '{}'".format(start_name, _target)
                        elif len(path_doors) == 0:
                            info = "[OK] Target equals start - no path needed."
                        else:
                            door_positions = {d["id"]: d["position"] for d in layout.get("doors", [])}
                            coords = []
                            sc_pt = _room_centroid(layout, start_name)
                            if sc_pt:
                                coords.append(sc_pt)
                            for did in path_doors:
                                if did in door_positions:
                                    coords.append(door_positions[did])
                            ec_pt = _room_centroid(layout, _target)
                            if ec_pt:
                                coords.append(ec_pt)

                            points = [rg.Point3d(p[0], p[1], 0) for p in coords]
                            if len(points) >= 2:
                                polyline = rg.Polyline(points).ToPolylineCurve()
                                info = "[OK] Path '{}' -> '{}' | doors: {} | points: {} | source: {} | preview: {}".format(
                                    start_name, _target, " -> ".join(path_doors),
                                    len(points), source, show_preview
                                )
                                if show_preview:
                                    err = draw_overlay(points)
                                    if err:
                                        info = info + " | [DRAW ERROR] " + err
                            else:
                                info = "[ERROR] Not enough points to build polyline"
# ---------- end py3_4 ----------

# ---- group: Input Layout
json_file_path = FilePath("C:\Users\gramo\Downloads\layout_clean.json")
json2string = Python3Script(path=json_file_path)  # -> out, json_string
# ---------- json2string: Python ----------
import sys
import json
from pathlib import Path


def read_json_as_string(path):
    path = Path(path)

    if not path.exists():
        raise FileNotFoundError(f"File not found: {file_path}")

    with open(path, "r", encoding="utf-8") as f:
        data = json.load(f)

    # Convert JSON object back to string
    json_string = json.dumps(data)

    return json_string

json_string = read_json_as_string(path)
# ---------- end json2string ----------

# ----
swatch = ColourSwatch(SwatchColor=RGB(0, 255, 255))
symsim = SymbolSimple(Style=flatten("5"), Size="5", Rotation=0, Colour=swatch)
symbol = SymbolDisplay(Location=py3_4.points, Display=symsim)

refresh_2 = Button()
path = FilePath(panel)
mini_json_local_downloader = Python3Script(url=path, refresh=refresh_2)  # -> out, local_path, a; inputs refresh: Boolean
# ---------- mini_json_local_downloader: Python ----------
import os
import datetime

# IronPython 2.7 (Rhino 7 / GH clasico) vs CPython (Rhino 8)
try:
    import urllib2
    def fetch(url):
        req = urllib2.Request(url, headers={"Cache-Control": "no-cache"})
        return urllib2.urlopen(req).read()
except ImportError:
    import urllib.request
    def fetch(url):
        req = urllib.request.Request(url, headers={"Cache-Control": "no-cache"})
        return urllib.request.urlopen(req).read()

# INPUTS:
#   url         -> str  (Item Access)  URL raw del JSON en GitHub
#   local_folder-> str  (Item Access)  carpeta donde guardar (opcional, default: Downloads)
#   filename    -> str  (Item Access)  nombre del archivo (opcional)
#   refresh     -> bool (Item Access)  Button para re-descargar
#
# OUTPUTS:
#   local_path -> ruta del archivo local descargado
#   a          -> mensaje de estado

# 1) Resolver carpeta destino (default: Downloads)
if local_folder and local_folder.strip():
    folder = local_folder.strip()
else:
    downloads = os.path.join(os.path.expanduser("~"), "Downloads")
    if not os.path.exists(downloads):
        descargas = os.path.join(os.path.expanduser("~"), "Descargas")
        if os.path.exists(descargas):
            downloads = descargas
        else:
            downloads = os.path.expanduser("~")
    folder = downloads

if not os.path.exists(folder):
    os.makedirs(folder)

# 2) Resolver nombre de archivo
if filename and filename.strip():
    name = filename.strip()
    if not name.lower().endswith(".json"):
        name += ".json"
else:
    # Default: <nombre_original>_temporal_file_<YYYY-MM-DD_HH-MM-SS>.json
    # Extraer nombre original desde la URL (ultimo segmento)
    try:
        url_clean = url.split("?")[0]  # quitar query strings tipo ?v=1
        original_basename = url_clean.split("/")[-1]
        original_name = os.path.splitext(original_basename)[0]
        if not original_name:
            original_name = "layout_schema"
    except:
        original_name = "layout_schema"

    timestamp = datetime.datetime.now().strftime("%Y-%m-%d_%H-%M-%S")
    name = "{}_temporal_file_{}.json".format(original_name, timestamp)

local_path = os.path.join(folder, name)

# 3) Descargar y guardar
try:
    raw = fetch(url)
    if isinstance(raw, bytes):
        try:
            text = raw.decode("utf-8")
        except UnicodeDecodeError:
            text = raw.decode("latin-1")
    else:
        text = raw

    with open(local_path, "w") as f:
        f.write(text)

    ts_display = datetime.datetime.now().strftime("%H:%M:%S")
    size_kb = len(text) / 1024.0
    a = "OK [{}]: descargado {:.1f} KB -> {}".format(ts_display, size_kb, local_path)

except Exception as e:
    a = "ERROR al descargar: {}".format(str(e))
# ---------- end mini_json_local_downloader ----------
py3_5 = Python3Script(
    path=mini_json_local_downloader.local_path,
    new_lines=py3_2.new_lines,
    new_ids=py3_2.new_ids,
    write=Toggle(False),
    delete_all=Toggle(False))  # -> out, a, updated_json, out_path, original_path; inputs path: String, new_lines: list of Curve, new_ids: list of String, write: Boolean, delete_all: Boolean
# ---------- py3_5: Python ----------
import json
import os
import datetime
import glob
import Rhino.Geometry as rg

# INPUTS:
#   path        -> str   (Item)   ruta del JSON original
#   new_lines   -> Curve (List)   lineas modificadas
#   new_ids     -> str   (List)   ids de las puertas modificadas
#   write       -> bool  (Item)   Button para guardar nueva version
#   delete_all  -> bool  (Item)   Button para borrar TODAS las versiones updated en Downloads
#
# OUTPUTS:
#   a             -> mensaje de estado
#   updated_json  -> string del JSON actualizado
#   out_path      -> ruta donde se guardo el archivo
#   original_path -> ruta del JSON original

original_path = path

# 1) Cargar JSON original
with open(path, "r") as f:
    data = json.load(f)

doors = data["doors"]

# 2) Resolver carpeta Downloads (default)
downloads = os.path.join(os.path.expanduser("~"), "Downloads")
if not os.path.exists(downloads):
    descargas = os.path.join(os.path.expanduser("~"), "Descargas")
    if os.path.exists(descargas):
        downloads = descargas
    else:
        downloads = os.path.expanduser("~")

if not os.path.exists(downloads):
    os.makedirs(downloads)

# 3) Construir nombre del archivo limpio
base = os.path.splitext(os.path.basename(path))[0]
clean_base = base.split("_temporal_file")[0]

now = datetime.datetime.now()
timestamp = now.strftime("%Y-%m-%d_%H-%M-%S")
new_filename = "{}_updated_{}.json".format(clean_base, timestamp)
out_path = os.path.join(downloads, new_filename)

# Patron de busqueda de versiones updated
pattern = os.path.join(downloads, "{}_updated_*.json".format(clean_base))

# ==========================================
# MODO BORRADO MANUAL: si delete_all es True
# ==========================================
if delete_all:
    old_files = glob.glob(pattern)
    deleted = 0
    deleted_names = []
    for old_file in old_files:
        try:
            os.remove(old_file)
            deleted += 1
            deleted_names.append(os.path.basename(old_file))
        except Exception:
            pass

    updated_json = ""
    if deleted == 0:
        a = "No habia archivos updated para borrar en {}".format(downloads)
    else:
        a = "BORRADO: {} archivos eliminados de Downloads -> {}".format(
            deleted, ", ".join(deleted_names)
        )

else:
    # ==========================================
    # MODO NORMAL: procesar updates
    # ==========================================

    def to_line(geo):
        if isinstance(geo, rg.Line):
            return geo
        if isinstance(geo, rg.LineCurve):
            return geo.Line
        if isinstance(geo, rg.Curve):
            return rg.Line(geo.PointAtStart, geo.PointAtEnd)
        raise TypeError("Geometria no soportada: {}".format(type(geo)))

    # Construir mapa de actualizaciones por ID
    updates = {}
    if new_ids and new_lines and len(new_ids) == len(new_lines):
        for door_id, geo in zip(new_ids, new_lines):
            updates[str(door_id).strip()] = to_line(geo)

    # Aplicar updates donde coincida el ID
    updated_count = 0
    for door in doors:
        did = door.get("id")
        if did in updates:
            line = updates[did]
            sp, ep = line.From, line.To
            door["start"] = [sp.X, sp.Y]
            door["end"]   = [ep.X, ep.Y]
            mid = (sp + ep) * 0.5
            door["position"] = [mid.X, mid.Y]
            door["width"]    = round(line.Length, 6)
            dx = abs(ep.X - sp.X)
            dy = abs(ep.Y - sp.Y)
            door["axis"] = "x" if dx >= dy else "y"
            updated_count += 1

    updated_json = json.dumps(data, indent=2)

    # Escribir y limpiar versiones viejas
    if write:
        old_files = glob.glob(pattern)
        deleted = 0
        for old_file in old_files:
            try:
                os.remove(old_file)
                deleted += 1
            except Exception:
                pass

        with open(out_path, "w") as f:
            f.write(updated_json)

        a = "OK: {} puertas actualizadas. Guardado en: {} | Eliminadas {} versiones viejas".format(
            updated_count, out_path, deleted
        )
    else:
        a = "Preview: {} puertas a actualizar (de {} solicitudes). Activa 'write' para guardar en: {}".format(
            updated_count, len(updates), out_path
        )
# ---------- end py3_5 ----------
panel_11 = Panel(py3_5.a)
panel_12 = Panel(py3_5.updated_json)

crv = Curve(py3_4.polyline)
preview = CustomPreview(Geometry=crv, Material=swatch)

crv_2 = Curve([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])

py3_6 = Python3Script(room_name=rjv_10.AsString)  # -> point
# ---------- py3_6: Python ----------
import json
import Rhino.Geometry as rg

path = r"D:\05- IAAC\03- Third Semester\05- AIA Studio\AIA-Studio_HaniKarime\AIA26_Studio\team_03\layout\layout.json"

# Debug
print("room_name received:", room_name)
print("type:", type(room_name))

if room_name is None:
    point = None
else:
    clean_name = str(room_name).strip().strip('"')
    
    with open(path, "r") as f:
        data = json.load(f)

    target = None
    for room in data["rooms"]:
        if room["name"].lower() == clean_name.lower():
            pts = room["geometry"]
            x = sum(p[0] for p in pts) / len(pts)
            y = sum(p[1] for p in pts) / len(pts)
            target = rg.Point3d(x, y, 0)
            break

    point = target
# ---------- end py3_6 ----------
ivist = IsoVist(Plane=py3_6, Count="300", Radius=rjv_9.AsNumber, Obstacles=crv_2)  # -> Points, Distance, Index
pline = PolyLine(Vertices=ivist.Points, Closed=invert(False))
path_2 = FilePath(json_file_path)
srf = Surface(pline)
py3_7 = Python3Script(boundary=pline, path=path_2, current_room=rjv_10.AsString)  # -> a; inputs boundary: Curve
# ---------- py3_7: Python ----------
import Rhino.Geometry as rg
import json

with open(path, "r") as f:
    data = json.load(f)

results = {}
step = 1.0
total_isovist_pts = 0

room_inside_counts = {}
room_total_counts = {}

for room in data["rooms"]:
    name = room["name"]
    pts = room["geometry"]
    
    xs = [p[0] for p in pts]
    ys = [p[1] for p in pts]
    min_x, max_x = min(xs), max(xs)
    min_y, max_y = min(ys), max(ys)
    
    total = 0
    inside = 0
    
    x = min_x
    while x <= max_x:
        y = min_y
        while y <= max_y:
            pt = rg.Point3d(x, y, 0)
            result = boundary.Contains(pt, rg.Plane.WorldXY, 0.01)
            if result == rg.PointContainment.Inside:
                inside += 1
                total_isovist_pts += 1
            total += 1
            y += step
        x += step
    
    room_inside_counts[name] = inside
    room_total_counts[name] = total

for name in room_inside_counts:
    total = room_total_counts[name]
    inside = room_inside_counts[name]
    if name == current_room:
        results[name] = 100.0
    elif total > 0:
        results[name] = round((inside / total) * 100, 1)
    else:
        results[name] = 0.0

a = json.dumps({"visibility": results}, indent=2)
# ---------- end py3_7 ----------
panel_13 = Panel(py3_7)

# ---- group: Get a Specific Room
py3_8 = Python3Script(json_str=rjv_11.AsString, room_name=gjok_12)  # -> out, a; inputs room_name: String; disabled
# ---------- py3_8: Python ----------
import json
import Rhino.Geometry as rg

# Inputs:
# json_str -> JSON as string
# room_name -> e.g. "Living Room"

def load_json_from_string(json_string):
    try:
        data = json.loads(json_string)
    except Exception as e:
        raise ValueError(f"Invalid JSON string: {e}")
    return data

def create_polyline(points):
    pts = [rg.Point3d(x, y, 0) for x, y in points]

    # Ensure closed
    if pts[0] != pts[-1]:
        pts.append(pts[0])

    return rg.Polyline(pts).ToPolylineCurve()

# Load JSON
data = load_json_from_string(json_str)

# Find the room
room_curve = None

for room in data.get("rooms", []):
    if room.get("name") == room_name:
        geometry = room.get("geometry")
        if geometry:
            room_curve = create_polyline(geometry)
        break

# Output ONLY the polyline
a = room_curve
# ---------- end py3_8 ----------

# ---- group: Extractor Tool do map json to grasshopper data
extractor = Python3Script(json_str=json2string.json_string)  # -> out, outline_curve, room_names, room_curves, door_names, door_curves, window_names, window_curves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
# ---------- extractor: Python ----------
import json
import Rhino.Geometry as rg

def load_json_from_string(json_string):
    try:
        data = json.loads(json_string)
    except Exception as e:
        raise ValueError(f"Invalid JSON string: {e}")
    return data

def create_polyline(points, close=True):
    """Create a Rhino PolylineCurve from 2D points"""
    pts = [rg.Point3d(x, y, 0) for x, y in points]

    if close and pts[0] != pts[-1]:
        pts.append(pts[0])

    return rg.Polyline(pts).ToPolylineCurve()

def create_line(points):
    """Create a Rhino LineCurve from 2 points"""
    if len(points) != 2:
        return None
    p1 = rg.Point3d(points[0][0], points[0][1], 0)
    p2 = rg.Point3d(points[1][0], points[1][1], 0)
    return rg.LineCurve(p1, p2)

# Load JSON
layout = load_json_from_string(json_str)

# ------------------------
# ROOMS (polygons)
# ------------------------
room_names = []
room_curves = []

for room in layout.get("rooms", []):
    name = room.get("name")
    geometry = room.get("geometry")

    if name and geometry:
        curve = create_polyline(geometry, close=True)
        room_names.append(name)
        room_curves.append(curve)

# ------------------------
# DOORS (lines)
# ------------------------
door_names = []
door_curves = []

for door in layout.get("doors", []):
    name = door.get("name")
    geometry = door.get("geometry")

    if name and geometry:
        curve = create_line(geometry)
        if curve:
            door_names.append(name)
            door_curves.append(curve)

# ------------------------
# WINDOWS (lines)
# ------------------------
window_names = []
window_curves = []

for window in layout.get("windows", []):
    name = window.get("name")
    geometry = window.get("geometry")

    if name and geometry:
        curve = create_line(geometry)
        if curve:
            window_names.append(name)
            window_curves.append(curve)

# ------------------------
# FURNITURE (polygons)
# ------------------------
furniture_names = []
furniture_curves = []

for furn in layout.get("furniture", []):
    name = furn.get("name")
    geometry = furn.get("geometry")

    if name and geometry:
        curve = create_polyline(geometry, close=True)
        furniture_names.append(name)
        furniture_curves.append(curve)

# ------------------------
# MEP (polygons)
# ------------------------
mep_names = []
mep_curves = []

for m in layout.get("mep", []):
    name = m.get("name")
    geometry = m.get("geometry")

    if name and geometry:
        curve = create_polyline(geometry, close=True)
        mep_names.append(name)
        mep_curves.append(curve)

# ------------------------
# STRUCTURE (lines)
# ------------------------
structure_names = []
structure_curves = []

for s in layout.get("structure", []):
    name = s.get("name")
    geometry = s.get("geometry")

    if name and geometry:
        curve = create_line(geometry)
        if curve:
            structure_names.append(name)
            structure_curves.append(curve)

# ------------------------
# OUTLINE (optional)
# ------------------------
outline_curve = None
if "outline" in layout:
    outline_curve = create_polyline(layout["outline"], close=True)

# ------------------------
# OUTPUTS
# ------------------------
a = room_names
b = room_curves

c = door_names
d = door_curves

e = window_names
f = window_curves

g = furniture_names
h = furniture_curves

i = mep_names
j = mep_curves

k = structure_names
l = structure_curves

m = outline_curve
# ---------- end extractor ----------

# ----
srf_2 = Surface(extractor.room_curves)

# ---- group: Labels
area_2 = Area(Geometry=srf_2)  # -> Area, Centroid
tag = TextTag(Location=area_2.Centroid, Text=extractor.room_names)

# ----
cjv = CreateJSONValue(Value=py3_7)
cjo = CreateJSONObject(Keys="visibility_result", Values=cjv)
respond = MCPToolResponse(Request=decall_6.Request, Content=cjo, IsError=False)

# ---- group: Output Layout
json_file_path_2 = FilePath(py3_5.out_path)
json2string_2 = Python3Script(path=json_file_path_2)  # -> out, json_string; same code as json2string

# ---- group: Input Layout
json_file_path_3 = FilePath(py3_5.original_path)
json2string_3 = Python3Script(path=json_file_path_3)  # -> out, json_string; same code as json2string

# ---- group: 0 = Before, 1= After
number_slider = Slider(1, range=0..1)

# ----
panel_14 = Panel(json_file_path_3)
panel_15 = Panel(json_file_path_2)
filter = StreamFilter(Gate=number_slider, Stream0=json2string_3.json_string, Stream1=json2string_2.json_string)

# ---- group: Extractor Tool do map json to grasshopper data
extractor_tool_do_map_json_to_grasshoppe = Python3Script(json_str=filter)  # -> out, outline_curve, room_names, room_curves, door_names, door_curves, window_names, window_curves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; "Extractor Tool do map json to grasshopper data"
# ---------- extractor_tool_do_map_json_to_grasshoppe: Python ----------
import json
import Rhino.Geometry as rg

def load_json_from_string(json_string):
    try:
        return json.loads(json_string)
    except Exception as ex:
        raise ValueError("Invalid JSON string: {}".format(ex))

def create_polyline(points, close=True):
    if not points or len(points) < 2:
        return None
    pts = [rg.Point3d(p[0], p[1], 0) for p in points]
    if close and pts[0].DistanceTo(pts[-1]) > 1e-9:
        pts.append(pts[0])
    return rg.Polyline(pts).ToPolylineCurve()

def create_line_from_points(p1, p2):
    a_pt = rg.Point3d(p1[0], p1[1], 0)
    b_pt = rg.Point3d(p2[0], p2[1], 0)
    return rg.LineCurve(a_pt, b_pt)

def door_to_line(door):
    if "start" in door and "end" in door:
        return create_line_from_points(door["start"], door["end"])
    geom = door.get("geometry")
    if geom and len(geom) >= 2:
        return create_line_from_points(geom[0], geom[1])
    return None

def line_geometry(item):
    if "start" in item and "end" in item:
        return create_line_from_points(item["start"], item["end"])
    geom = item.get("geometry")
    if geom and len(geom) >= 2:
        return create_line_from_points(geom[0], geom[1])
    return None

def label_of(item, fallback_prefix, index):
    return item.get("name") or item.get("id") or "{}_{}".format(fallback_prefix, index)

# ---------- INPUT ----------
# json_str -> str (Item Access)

layout = load_json_from_string(json_str)

# ---------- ROOMS ----------
room_names = []
room_curves = []
for idx, room in enumerate(layout.get("rooms", [])):
    geometry = room.get("geometry")
    if not geometry:
        continue
    curve = create_polyline(geometry, close=True)
    if curve is None:
        continue
    room_names.append(label_of(room, "room", idx))
    room_curves.append(curve)

# ---------- DOORS ----------
door_names = []
door_curves = []
for idx, door in enumerate(layout.get("doors", [])):
    curve = door_to_line(door)
    if curve is None:
        continue
    door_names.append(label_of(door, "door", idx))
    door_curves.append(curve)

# ---------- WINDOWS ----------
window_names = []
window_curves = []
for idx, win in enumerate(layout.get("windows", [])):
    curve = line_geometry(win)
    if curve is None:
        continue
    window_names.append(label_of(win, "window", idx))
    window_curves.append(curve)

# ---------- FURNITURE ----------
furniture_names = []
furniture_curves = []
for idx, furn in enumerate(layout.get("furniture", [])):
    geometry = furn.get("geometry")
    if not geometry:
        continue
    curve = create_polyline(geometry, close=True)
    if curve is None:
        continue
    furniture_names.append(label_of(furn, "furniture", idx))
    furniture_curves.append(curve)

# ---------- MEP ----------
mep_names = []
mep_curves = []
for idx, m in enumerate(layout.get("mep", [])):
    geometry = m.get("geometry")
    if not geometry:
        continue
    curve = create_polyline(geometry, close=True)
    if curve is None:
        continue
    mep_names.append(label_of(m, "mep", idx))
    mep_curves.append(curve)

# ---------- STRUCTURE ----------
structure_names = []
structure_curves = []
for idx, s in enumerate(layout.get("structure", [])):
    curve = line_geometry(s)
    if curve is None:
        continue
    structure_names.append(label_of(s, "structure", idx))
    structure_curves.append(curve)

# ---------- OUTLINE ----------
outline_curve = None
if "outline" in layout and layout["outline"]:
    outline_curve = create_polyline(layout["outline"], close=True)

# ---------- OUT (status) ----------
out = "OK: {} rooms | {} doors | {} windows | {} furniture | {} mep | {} structure | outline: {} | start_room: {}".format(
    len(room_names), len(door_names), len(window_names),
    len(furniture_names), len(mep_names), len(structure_names),
    "yes" if outline_curve else "no",
    layout.get("start_room", "n/a")
)
# ---------- end extractor_tool_do_map_json_to_grasshoppe ----------

# ---- group: Doors
data = Data(extractor_tool_do_map_json_to_grasshoppe.door_curves)
previewlw = CustomPreviewLineweights(Geometry=data, Shader=ColourSwatch(SwatchColor=RGB(255, 0, 56)), Thickness=Slider(5.4, range=0..10), Absolute=False)

# ---- group: Windows
data_2 = Data(extractor_tool_do_map_json_to_grasshoppe.window_curves)
previewlw_2 = CustomPreviewLineweights(Geometry=data_2, Shader=ColourSwatch(SwatchColor=RGB(56, 56, 56)), Thickness=Slider(5.4, range=0..10), Absolute=False)

# ---- group: Polylines
srf_3 = Surface(extractor_tool_do_map_json_to_grasshoppe.room_curves)
preview_2 = CustomPreview(Geometry=srf_3, Material=[ColourSwatch(SwatchColor=RGB(167, 219, 44)), ColourSwatch(SwatchColor=RGB(4, 154, 184))])

# ---- group: Labels
area_3 = Area(Geometry=srf_3)  # -> Area, Centroid
tag_2 = TextTag(Location=area_3.Centroid, Text=extractor_tool_do_map_json_to_grasshoppe.room_names)

# ----
deconstruct_tool_call_2 = DeconstructToolCall(Request=sift.Output3)  # -> Request, Tool, Arguments

# ---- group: check_door_widths
python_3_script = Python3Script(json_str=deconstruct_tool_call_2.Arguments, layout_str=py3.raw_json)  # -> out, a
# ---------- python_3_script: Python ----------
import json

try:
    # 1) layout completo viene del downloader
    layout = json.loads(str(layout_str))

    # 2) min_door_width: prioriza el del LLM si llego, si no usa default
    min_width = 0.85
    if json_str:
        try:
            args = json.loads(str(json_str))
            if isinstance(args, dict) and "min_door_width" in args:
                min_width = float(args["min_door_width"])
        except:
            pass

    doors = layout.get("doors", [])
    conflict_ids = []
    clear_ids = []

    for door in doors:
        door_id = door.get("id", "unknown")
        width = door.get("width", 0)

        if width < min_width:
            conflict_ids.append(door_id)
        else:
            clear_ids.append(door_id)

    a = json.dumps({
        "conflicts": conflict_ids,
        "passed": clear_ids,
        "target_width": min_width,
        "summary": "{} of {} doors below {}m".format(
            len(conflict_ids), len(doors), min_width
        )
    }, indent=2)

except Exception as e:
    a = json.dumps({"error": str(e)})
# ---------- end python_3_script ----------

# ----
parse_json_string_2 = ParseJSONString(Text=python_3_script.a)
mcp_tool_response_2 = MCPToolResponse(Request=deconstruct_tool_call_2.Request, Content=parse_json_string_2, IsError=False)

deconstruct_tool_call_3 = DeconstructToolCall(Request=sift.Output2)  # -> Request, Tool, Arguments

# ---- group: shortest_path
python_3_script_2 = Python3Script(json_str=deconstruct_tool_call_3.Arguments)  # -> out, a
# ---------- python_3_script_2: Python ----------
import json
import math
from collections import deque

def build_graph(layout):
    graph = {}
    for room in layout["rooms"]:
        graph[room["id"]] = []
    for door in layout["doors"]:
        if len(door["connects"]) < 2:
            continue
        r1, r2 = door["connects"]
        graph[r1].append({"room": r2, "door": door["id"], "position": door["position"]})
        graph[r2].append({"room": r1, "door": door["id"], "position": door["position"]})
    return graph

def get_room_id(layout, name):
    for room in layout["rooms"]:
        if room["name"] == name:
            return room["id"]
    return None

def get_room_name(layout, room_id):
    for room in layout["rooms"]:
        if room["id"] == room_id:
            return room["name"]
    return room_id

def bfs_shortest_paths(graph, start_id):
    distances = {start_id: 0}
    doors_used = {start_id: []}
    queue = deque([start_id])
    while queue:
        current = queue.popleft()
        for neighbor in graph[current]:
            nid = neighbor["room"]
            if nid not in distances:
                distances[nid] = distances[current] + 1
                doors_used[nid] = doors_used[current] + [neighbor["door"]]
                queue.append(nid)
    return distances, doors_used

def door_position_score(layout, graph, start_id, distances):
    door_scores = {}
    for door in layout["doors"]:
        if len(door["connects"]) < 2:
            continue
        r1, r2 = door["connects"]
        d1 = distances.get(r1, 999)
        d2 = distances.get(r2, 999)
        far_room = r2 if d1 < d2 else r1
        near_room = r1 if d1 < d2 else r2
        alt_connections = [n for n in graph[near_room] if n["room"] != far_room]
        if alt_connections:
            avg_x = sum(n["position"][0] for n in alt_connections) / len(alt_connections)
            avg_y = sum(n["position"][1] for n in alt_connections) / len(alt_connections)
            dx = door["position"][0] - avg_x
            dy = door["position"][1] - avg_y
            deviation = math.sqrt(dx**2 + dy**2)
        else:
            deviation = 0
        if deviation < 1.0:
            score = 1
            label = "optimal"
            advice = "Door position is well placed."
        elif deviation < 2.5:
            score = 2
            label = "minor issue"
            advice = "Consider shifting {} closer to the main circulation center.".format(door["id"])
        else:
            score = 3
            label = "bottleneck"
            advice = "Door {} is far from the main path - shifting it could shorten access.".format(door["id"])
        door_scores[door["id"]] = {
            "door_id": door["id"],
            "connects": door["connects"],
            "position": door["position"],
            "deviation": round(deviation, 2),
            "score": score,
            "label": label,
            "advice": advice
        }
    return door_scores


# ── MAIN ────────────────────────────────────────────────────────────────────
try:
    # 1) Extraer start_room del wrapper del LLM (si esta)
    start_room = "corridor"  # default
    if json_str and str(json_str).strip():
        try:
            wrapper = json.loads(str(json_str).strip())
            if isinstance(wrapper, dict):
                if "start_room" in wrapper:
                    start_room = wrapper["start_room"]
        except:
            pass

    # 2) Permitir override manual del start_room
    try:
        if start_room_input and str(start_room_input).strip():
            start_room = str(start_room_input).strip()
    except NameError:
        pass

    # 3) Cargar layout SIEMPRE desde layout_str (Downloader local, confiable)
    if not layout_str or not str(layout_str).strip():
        raise ValueError("Input 'layout_str' is empty. Connect the downloader's raw_text to it.")

    layout = json.loads(str(layout_str))

    if not isinstance(layout, dict) or "rooms" not in layout or "doors" not in layout:
        raise ValueError("Layout from layout_str missing 'rooms' or 'doors'. Got keys: {}".format(
            list(layout.keys()) if isinstance(layout, dict) else type(layout).__name__
        ))

    # 4) Procesar
    graph = build_graph(layout)
    start_id = get_room_id(layout, start_room)

    if not start_id:
        available_rooms = [r.get("name") for r in layout.get("rooms", [])]
        a = json.dumps({
            "error": "Room '{}' not found.".format(start_room),
            "available_rooms": available_rooms
        })
    else:
        distances, doors_used = bfs_shortest_paths(graph, start_id)
        door_scores = door_position_score(layout, graph, start_id, distances)

        rooms_result = []
        for room_id, depth in distances.items():
            rooms_result.append({
                "room": get_room_name(layout, room_id),
                "depth_from_entry": depth,
                "path_doors": doors_used[room_id]
            })

        doors_result = []
        for did, data in door_scores.items():
            doors_result.append({
                "door_id": data["door_id"],
                "connects": [
                    get_room_name(layout, data["connects"][0]),
                    get_room_name(layout, data["connects"][1])
                ],
                "position": data["position"],
                "deviation": data["deviation"],
                "score": data["score"],
                "label": data["label"],
                "advice": data["advice"]
            })

        a = json.dumps({
            "start_room": start_room,
            "rooms": rooms_result,
            "door_scores": doors_result
        }, indent=2)

except Exception as e:
    a = json.dumps({
        "error": str(e),
        "input_preview": str(json_str)[:200] if json_str else "(empty)"
    })
# ---------- end python_3_script_2 ----------

# ----
parse_json_string_3 = ParseJSONString(Text=python_3_script_2.a)
mcp_tool_response_3 = MCPToolResponse(Request=deconstruct_tool_call_3.Request, Content=parse_json_string_3, IsError=False)

decall_7 = DeconstructToolCall()  # -> Request, Tool, Arguments; disabled
panel_16 = Panel("layout_json")  # disabled
panel_17 = Panel("room_name")  # disabled
gjok_14 = GetJSONObjectKey(JObject=decall_7.Arguments, Key=panel_16)  # disabled
gjok_15 = GetJSONObjectKey(JObject=decall_7.Arguments, Key=panel_17)  # disabled
rjv_12 = ReadJSONValue(JValue=gjok_14)  # -> AsString, AsNumber, AsBool; disabled

# ---- group: Delete a Space by name
py3_9 = Python3Script(json_str=rjv_12.AsString, room_name=gjok_15)  # -> out, a; inputs room_name: String; disabled
# ---------- py3_9: Python ----------
import json
import copy

# Inputs:
# json_str -> JSON as string
# room_name -> e.g. "Kitchen"

def load_json_from_string(json_string):
    try:
        data = json.loads(json_string)
    except Exception as e:
        raise ValueError(f"Invalid JSON string: {e}")
    return data

# Load JSON
data = load_json_from_string(json_str)

# Work on a copy
filtered = copy.deepcopy(data)

# ------------------------
# 1. Find room IDs to remove
# ------------------------
ids_to_remove = set()

for room in filtered.get("rooms", []):
    if room.get("name") == room_name:
        ids_to_remove.add(room.get("id"))

# ------------------------
# 2. Remove from rooms
# ------------------------
filtered["rooms"] = [
    r for r in filtered.get("rooms", [])
    if r.get("id") not in ids_to_remove
]

# ------------------------
# 3. Remove / clean DOORS
# (remove doors that connect to deleted rooms)
# ------------------------
filtered["doors"] = [
    d for d in filtered.get("doors", [])
    if not any(rid in ids_to_remove for rid in d.get("attributes", {}).get("connectsRooms", []))
]

# ------------------------
# 4. Remove WINDOWS linked to deleted rooms
# ------------------------
filtered["windows"] = [
    w for w in filtered.get("windows", [])
    if w.get("attributes", {}).get("roomId") not in ids_to_remove
]

# ------------------------
# 5. Remove FURNITURE linked to deleted rooms
# ------------------------
filtered["furniture"] = [
    f for f in filtered.get("furniture", [])
    if f.get("attributes", {}).get("roomId") not in ids_to_remove
]

# ------------------------
# 6. (Optional) MEP cleanup
# (only if tied to rooms — currently not in your schema)
# ------------------------
# Keeping all MEP elements for now

# ------------------------
# 7. STRUCTURE
# (typically global, so we keep it)
# ------------------------

# ------------------------
# Output ONLY as string
# ------------------------
a = json.dumps(filtered, indent=2)
# ---------- end py3_9 ----------

# ----
pjs = ParseJSONString(Text=py3_9.a)  # disabled
respond_2 = MCPToolResponse(Request=decall_7.Request, Content=pjs, IsError=False)  # disabled

rjv_13 = ReadJSONValue(JValue=gjok_13)  # -> AsString, AsNumber, AsBool; disabled
panel_18 = Panel("2")  # disabled
division = Division(A=rjv_13.AsNumber, B=panel_18)  # disabled

# ---- group: Design Logic to Add a Window
room_polyline = Data(py3_8.a)  # disabled
debrep = DeconstructBrep(Brep=room_polyline)  # -> Faces, Edges, Vertices; disabled
item = ListItem(List=debrep.Edges, Index=0, Wrap=True)  # disabled
midpt = CurveMiddle(Curve=item)  # disabled
X = UnitX(Factor=division)  # disabled
move_3 = Move(Geometry=midpt, Motion=expr("-x", X))  # -> Geometry, Transform; disabled
move_4 = Move(Geometry=midpt, Motion=X)  # -> Geometry, Transform; disabled
merge = Merge(Data1=move_4.Geometry, Data2=move_3.Geometry)  # disabled

# ---- group: Creates a Window Object
panel_19 = Panel("South Window")  # disabled
panel_20 = Panel("window-2")  # disabled
txt = Text(merge)  # disabled
window_object = Python3Script(element_id=panel_20, name=panel_19, geometry=txt)  # -> out, window_obj; inputs element_id: String, geometry: list; disabled
# ---------- window_object: Python ----------
import json

def parse_point_string(pt_str):
    """
    Converts '{3.5, 0, 0}' -> [3.5, 0.0]
    """
    # Remove braces and spaces
    cleaned = pt_str.strip().replace("{", "").replace("}", "")
    
    # Split into components
    parts = cleaned.split(",")
    
    if len(parts) < 2:
        raise ValueError(f"Invalid point format: {pt_str}")
    
    x = float(parts[0])
    y = float(parts[1])
    
    return [x, y]

def serialize_geometry(geometry_list):
    """
    Converts list of GH strings into [[x,y], [x,y]]
    """
    return [parse_point_string(pt) for pt in geometry_list]

# ------------------------
# Convert geometry
# ------------------------
serialized_geometry = serialize_geometry(geometry)

# Build window object
window_obj = {
    "id": element_id,
    "name": name,
    "geometry": serialized_geometry
}

# Optional attributes
if attributes:
    window_obj["attributes"] = attributes

# Output ONLY as JSON string
window_obj = json.dumps(window_obj, indent=2)
# ---------- end window_object ----------

# ---- group: Merge it to the original layout json
py3_10 = Python3Script(json_str=rjv_11.AsString, new_object=window_object.window_obj)  # -> out, updated_layout; disabled
# ---------- py3_10: Python ----------
import json
import copy

def load_json_from_string(json_string):
    try:
        return json.loads(json_string)
    except Exception as e:
        raise ValueError(f"Invalid JSON string: {e}")

def detect_object_type(obj):
    """
    Infer target list from object id prefix.
    """
    obj_id = obj.get("id", "").lower()

    if obj_id.startswith("window"):
        return "windows"
    elif obj_id.startswith("door"):
        return "doors"
    elif obj_id.startswith("furn") or obj_id.startswith("furniture"):
        return "furniture"
    elif obj_id.startswith("mep"):
        return "mep"
    elif obj_id.startswith("wall") or obj_id.startswith("structure"):
        return "structure"
    else:
        # default fallback (safe choice)
        return "windows"

# ------------------------
# Load inputs
# ------------------------
layout = load_json_from_string(json_str)
new_object = json.loads(new_object)  # assuming object comes as JSON string

# Work on copy
updated = copy.deepcopy(layout)

# ------------------------
# Detect target category
# ------------------------
target_key = detect_object_type(new_object)

# ------------------------
# Ensure list exists
# ------------------------
if target_key not in updated:
    updated[target_key] = []

# ------------------------
# Insert object
# ------------------------
updated[target_key].append(new_object)

# ------------------------
# Output JSON string
# ------------------------
updated_layout = json.dumps(updated, indent=2)
# ---------- end py3_10 ----------

# ----
pjs_2 = ParseJSONString(Text=py3_10.updated_layout)  # disabled
respond_3 = MCPToolResponse(Request=decall_3.Request, Content=pjs_2, IsError=False)  # disabled

panel_21 = Panel(area.Area)  # disabled
panel_22 = Panel(volume.Volume)  # disabled
cjv_2 = CreateJSONValue(Value=panel_21)  # disabled
cjv_3 = CreateJSONValue(Value=panel_22)  # disabled
merge_2 = Merge(Data1=flatten(py3_9.a), Data2=flatten(py3_10.updated_layout))  # disabled
panel_23 = Panel("area")  # disabled
panel_24 = Panel("volume")  # disabled
cjo_2 = CreateJSONObject(Keys=panel_23, Values=cjv_2)  # disabled
cjo_3 = CreateJSONObject(Keys=panel_24, Values=cjv_3)  # disabled
respond_4 = MCPToolResponse(Request=decall_4.Request, Content=cjo_3, IsError=False)  # disabled
respond_5 = MCPToolResponse(Request=decall_5.Request, Content=cjo_2, IsError=False)  # disabled

# ---- group: Extractor Tool do map json to grasshopper data
extractor_2 = Python3Script(json_str=merge_2)  # -> out, outline_curve, room_names, room_curves, door_names, door_curves, window_names, window_curves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; disabled; same code as extractor

# ---- group: Polylines
swatch_2 = ColourSwatch(SwatchColor=RGB(167, 219, 44))  # disabled
swatch_3 = ColourSwatch(SwatchColor=RGB(4, 154, 184))  # disabled
srf_4 = Surface(extractor_2.room_curves)  # disabled
preview_3 = CustomPreview(Geometry=srf_4, Material=[swatch_2, swatch_3])  # disabled

# ---- group: Windows
number_slider_2 = Slider(5.4, range=0..10)  # disabled
swatch_4 = ColourSwatch(SwatchColor=RGB(56, 56, 56))  # disabled
data_3 = Data(extractor_2.window_curves)  # disabled
previewlw_3 = CustomPreviewLineweights(Geometry=data_3, Shader=swatch_4, Thickness=number_slider_2, Absolute=False)  # disabled

# ---- group: Labels
area_4 = Area(Geometry=srf_4)  # -> Area, Centroid; disabled
tag_3 = TextTag(Location=area_4.Centroid, Text=extractor_2.room_names)  # disabled

# ----
path_curve_polyline_here = Curve(py3_4.polyline)
explode = Explode(Curve=reparameterize(path_curve_polyline_here), Recursive=True)  # -> Segments, Vertices
len = Length(Curve=explode.Segments)
ma = MassAddition(Input=len)  # -> Result, PartialResults
division_2 = Division(A=ma.PartialResults, B=ma.Result)
num = Number(rjv.AsNumber)
larger = LargerThan(FirstNumber=num, SecondNumber=division_2)  # -> LargerThan, OrEqualTo
eval = EvaluateCurve(Curve=reparameterize(path_curve_polyline_here), Parameter=num)  # -> Point, Tangent, Angle
ma_2 = MassAddition(Input=larger.LargerThan)  # -> Result, PartialResults
num_2 = Number(rjv_2.AsNumber)
item_2 = ListItem(List=reverse(num_2), Index=ma_2.Result, Wrap=True)

multiplication = Multiplication(A=item_2, B="2")

room_walls = Curve(crv_2)
layout_curves_here = Curve(room_walls)
cir = Circle(Plane=eval.Point, Radius=multiplication)
ccx = CurveCurve(CurveA=cir, CurveB=layout_curves_here)  # -> Points, ParamsA, flatten(ParamsB)
lng = ListLength(List=ccx.ParamsB)
larger_2 = LargerThan(FirstNumber=lng, SecondNumber="1")  # -> LargerThan, OrEqualTo

filter_2 = StreamFilter(
    Gate=larger_2.OrEqualTo,
    Stream0=ColourSwatch(SwatchColor=RGB(56, 224, 0)),
    Stream1=ColourSwatch(SwatchColor=RGB(224, 0, 0)))
preview_4 = CustomPreview(Geometry=cir, Material=filter_2)

filter_3 = StreamFilter(Gate=larger_2.OrEqualTo, Stream0="accessible", Stream1="collision detected")

panel_25 = Panel(num)
panel_26 = Panel(ma_2.Result)
concat = Concatenate(
    FragmentA=filter_3,
    FragmentB=" at segment ",
    FragmentC=panel_26,
    FragmentG="polyline domain value: ",
    FragmentF=panel_25,
    FragmentE=py3_4.info)

panel_27 = Panel(concat)
parse_json_string_4 = ParseJSONString(Text=panel_27)
respond_6 = MCPToolResponse(Request=decall_2.Request, Content=parse_json_string_4, IsError=False)

or = GateOr(
    A=respond_4,
    B=respond_5,
    C=respond_2,
    D=respond_3,
    E=respond,
    F=respond_6,
    G=mcp_tool_response_3,
    H=mcp_tool_response_2,
    I=mcp_tool_response)
tool_call_success = ClusterOutput(or)
