# Grasshopper definition team_04_working_site_constrain.gh (Grasshopper 1.0.8)
# plug-ins: Pufferfish, Human, Swiftlet

# ----
# Connect MCP Tools to Decall and Update All Clusters
# IF SOMETHING IS NOT
# WORKING PRESS THIS
# BUTTON FIRST
toggle = BooleanToggle(True)
button = Button()
update_all_clusters = CSharpScript(update=button, recursive=toggle)  # -> out, A; inputs update: Boolean, recursive: Boolean, passwords: list of String, localPath: String
# ---------- update_all_clusters: C# ----------
using System;
using System.Collections;
using System.Collections.Generic;

using Rhino;
using Rhino.Geometry;

using Grasshopper;
using Grasshopper.Kernel;
using Grasshopper.Kernel.Data;
using Grasshopper.Kernel.Types;
using System.Windows.Forms;
using System.Linq;
/// <summary>
/// This class will be instantiated on demand by the Script component.
/// </summary>
public class Script_Instance : GH_ScriptInstance
{
  /// <summary>Print a String to the [Out] Parameter of the Script component.</summary>
  /// <param name="text">String to print.</param>
  private void Print(string text) { /* Implementation hidden. */ }
  /// <summary>Print a formatted String to the [Out] Parameter of the Script component.</summary>
  /// <param name="format">String format.</param>
  /// <param name="args">Formatting parameters.</param>
  private void Print(string format, params object[] args) { /* Implementation hidden. */ }
  /// <summary>Print useful information about an object instance to the [Out] Parameter of the Script component. </summary>
  /// <param name="obj">Object instance to parse.</param>
  private void Reflect(object obj) { /* Implementation hidden. */ }
  /// <summary>Print the signatures of all the overloads of a specific method to the [Out] Parameter of the Script component. </summary>
  /// <param name="obj">Object instance to parse.</param>
  private void Reflect(object obj, string method_name) { /* Implementation hidden. */ }

  /// <summary>Gets the current Rhino document.</summary>
  private readonly RhinoDoc RhinoDocument;
  /// <summary>Gets the Grasshopper document that owns this script.</summary>
  private readonly GH_Document GrasshopperDocument;
  /// <summary>Gets the Grasshopper script component that owns this script.</summary>
  private readonly IGH_Component Component;
  /// <summary>
  /// Gets the current iteration count. The first call to RunScript() is associated with Iteration==0.
  /// Any subsequent call within the same solution will increment the Iteration count.
  /// </summary>
  private readonly int Iteration;

  /// <summary>
  /// This procedure contains the user code. Input parameters are provided as regular arguments,
  /// Output parameters as ref arguments. You don't have to assign output parameters,
  /// they will have a default value.
  /// </summary>
  private void RunScript(
		bool update,
		bool recursive,
		List<string> passwords,
		string localPath,
		ref object A)
  {

    A = updateLog;
    if (update)
    {
      updateLog = new List<string>();
      _passwords = passwords;
      UpdateClusters(GrasshopperDocument, recursive, localPath);
    }

  }

  // <Custom additional code> 
  List<string> updateLog;
  List<String> _passwords;

  void UpdateClusters (GH_Document ghDoc, bool recursive, string localPath)
  {
    foreach (var obj in ghDoc.Objects)
    {
      var cluster = obj as Grasshopper.Kernel.Special.GH_Cluster;
      if (cluster != null)
      {
        var clusterPath = cluster.FilePath;
        if (!string.IsNullOrEmpty(clusterPath))
        {
          if (cluster.Synchronisation == Grasshopper.Kernel.Special.GH_Synchronisation.OutOfDate)
          {
            cluster.CreateFromFilePath(clusterPath);
            updateLog.Add("Updated: " + clusterPath);
          }
          else if (cluster.Synchronisation == Grasshopper.Kernel.Special.GH_Synchronisation.MissingReference)
          {
            string newPath = ReplacePath(localPath, clusterPath);
            if (!string.IsNullOrEmpty(newPath))
            {
              cluster.CreateFromFilePath(newPath);
              updateLog.Add("Replaced and updated: " + newPath);
            }
            else
            {
              updateLog.Add("Missing reference: " + clusterPath);
            }

          }
        }

        //Update recursively
        if (recursive)
        {
          GH_Document clusterDoc = GetClusterDoc(cluster);
          if (clusterDoc != null)
            UpdateClusters(clusterDoc, recursive, localPath);
        }
      }
    }
  }

  GH_Document GetClusterDoc(Grasshopper.Kernel.Special.GH_Cluster cluster)
  {
    //no pass needed
    var doc = cluster.Document(string.Empty);
    if (doc != null)
      return doc;

    //try passwords
    if (_passwords != null && _passwords.Any())
    {
      foreach (var pass in _passwords)
      {
        doc = cluster.Document(pass);
        if (doc != null)
          return doc;
      }
    }

    return null;
  }

  string ReplacePath(string localPath, string missingPath)
  {
    if (String.IsNullOrEmpty(missingPath) || string.IsNullOrEmpty(localPath))
      return null;
    else
    {
      string lastLocalPart = localPath.Split('\\').Last();
      string[] parts = missingPath.Split('\\');
      if (parts.Contains(lastLocalPart))
      {
        int i = Array.IndexOf(parts, lastLocalPart);
        string clusterPath = String.Join("\\", parts.Skip(i + 1));
        string result = String.Join("\\", localPath, clusterPath);
        return result;
      }
      else
        return null;
    }
  }
  // </Custom additional code> 
}
# ---------- end update_all_clusters ----------
connect_mcp_tools_to_decall = CSharpScript(nickname_From="Central MCP Server", nickname_To="Central DeCall", connect=button)  # -> out; inputs nickname_From: String, nickname_To: String, connect: Boolean
# ---------- connect_mcp_tools_to_decall: C# ----------
using System;
using System.Linq;
using Grasshopper;
using Grasshopper.Kernel;

public class Script_Instance : GH_ScriptInstance
{
    private void RunScript(string nickname_From, string nickname_To, bool connect)
    {
        if (!connect) return;
        Console.Write($"Attempting to connect outputs from '{nickname_From}' to '{nickname_To}'...");

        var ghDoc = Instances.ActiveCanvas?.Document;
        if (ghDoc == null) return;

        var compFrom = ghDoc.Objects
            .OfType<IGH_Component>()
            .FirstOrDefault(o => o.NickName == nickname_From);

        var compTo = ghDoc.Objects
            .OfType<IGH_Param>()
            .FirstOrDefault(o => o.NickName == nickname_To);

        if (compFrom != null && compTo != null)
        {
            ghDoc.ScheduleSolution(5, doc => Connect(doc, compFrom, compTo));
        }
    }

    // <Custom additional code> 
    private void Connect(GH_Document doc, IGH_Component compFrom, IGH_Param compTo)
    {
        if (compFrom == null || compTo == null) return;

        foreach (IGH_Param param in compFrom.Params.Output)
        {
            compTo.AddSource(param);
        }
    }
}
# ---------- end connect_mcp_tools_to_decall ----------
panel = Panel(connect_mcp_tools_to_decall)

team_04_definition_cluster = Team04DefinitionCluster()
c_script = CSharpScript()  # -> out, availablePort
# ---------- c_script: C# ----------
// Grasshopper Script Instance
// This script finds an available port on the local machine.
#region Usings
using System;
using System.Linq;
using System.Collections;
using System.Collections.Generic;
using System.Drawing;
using System.Net;
using System.Net.Sockets;

using Rhino;
using Rhino.Geometry;

using Grasshopper;
using Grasshopper.Kernel;
using Grasshopper.Kernel.Data;
using Grasshopper.Kernel.Types;
#endregion

public class Script_Instance : GH_ScriptInstance
{
    #region Notes
    /* 
      Members:
        RhinoDoc RhinoDocument
        GH_Document GrasshopperDocument
        IGH_Component Component
        int Iteration

      Methods (Virtual & overridable):
        Print(string text)
        Print(string format, params object[] args)
        Reflect(object obj)
        Reflect(object obj, string method_name)
    */
    #endregion

    private void RunScript(object start, object end, ref object availablePort)
    {
        // Use default values if parameters are not provided
        int startPort = (start != null && int.TryParse(start.ToString(), out int s)) ? s : 3001;
        int endPort = (end != null && int.TryParse(end.ToString(), out int e)) ? e : 3100;

        // Find an available port in the specified range
        try
        {
            availablePort = FindAvailablePortInRange(startPort, endPort);
            Print($"Available port found: {availablePort}");
        }
        catch (Exception ex)
        {
            Print($"Error: {ex.Message}");
            availablePort = null;
        }
    }

    /// <summary>
    /// Checks if a local TCP port is available for binding (i.e., not in use).
    /// Returns True if available, False otherwise.
    /// </summary>
    private bool IsPortAvailableForBind(int port)
    {
        try
        {
            // Create a new TCP socket
            using (Socket socket = new Socket(AddressFamily.InterNetwork, SocketType.Stream, ProtocolType.Tcp))
            {
                // Try to bind to the port on all interfaces (0.0.0.0)
                socket.Bind(new IPEndPoint(IPAddress.Any, port));
                // If successful, the socket is closed by the using statement and return True
                return true;
            }
        }
        catch (SocketException)
        {
            // If binding fails, it means the port is already in use
            return false;
        }
    }

    /// <summary>
    /// Finds an available port by letting the OS assign one.
    /// </summary>
    private int FindAvailablePort()
    {
        Socket socket = new Socket(AddressFamily.InterNetwork, SocketType.Stream, ProtocolType.Tcp);
        socket.Bind(new IPEndPoint(IPAddress.Any, 0)); // Bind to an available port assigned by the OS
        int availablePort = ((IPEndPoint)socket.LocalEndPoint).Port; // Get the assigned port number
        socket.Close(); // Close the socket
        return availablePort;
    }

    /// <summary>
    /// Finds the first available port in a given range.
    /// </summary>
    private int FindAvailablePortInRange(int start = 3001, int end = 3100)
    {
        for (int port = start; port <= end; port++)
        {
            if (IsPortAvailableForBind(port))
                return port;
        }
        throw new Exception($"No available ports found in the range {start}-{end}.");
    }
}
# ---------- end c_script ----------
central_mcp_server = MCPServer(Port=c_script.availablePort, Tools=team_04_definition_cluster, ServerName="Swiftlet")  # -> Compute_area_of_cylinder, Compute_volume_of_cylinder, Delete_room_04, Add_window_04, Site_boundary
get_tool_names = CSharpScript(x=team_04_definition_cluster)  # -> flatten(out)
# ---------- get_tool_names: C# ----------
// Grasshopper Script Instance
#region Usings
using System;
using System.Linq;
using System.Collections;
using System.Collections.Generic;
using System.Drawing;

using Rhino;
using Rhino.Geometry;

using Grasshopper;
using Grasshopper.Kernel;
using Grasshopper.Kernel.Data;
using Grasshopper.Kernel.Types;
#endregion

public class Script_Instance : GH_ScriptInstance
{
    #region Notes
    /* 
      Members:
        RhinoDoc RhinoDocument
        GH_Document GrasshopperDocument
        IGH_Component Component
        int Iteration

      Methods (Virtual & overridable):
        Print(string text)
        Print(string format, params object[] args)
        Reflect(object obj)
        Reflect(object obj, string method_name)
    */
    #endregion

    private void RunScript(object x)
    {
        dynamic dynamicX = x;
        Console.Write(dynamicX.Name);
    }
}
# ---------- end get_tool_names ----------
panel_2 = Panel(c_script.availablePort)
central_decall = Data([central_mcp_server.Compute_area_of_cylinder, central_mcp_server.Compute_volume_of_cylinder, central_mcp_server.Delete_room_04, central_mcp_server.Add_window_04, central_mcp_server.Site_boundary])

# ---- group: Input Layout
json_file_path = FilePath("C:\Users\jomig\repos\AIA26_Studio\layout_input\layout_schema.json")
json2string = Python3Script(path=json_file_path)  # -> out, json_string
# ---------- json2string: Python ----------
import sys
import json
from pathlib import Path


def read_json_as_string(path):
    path = Path(path)

    if not path.exists():
        raise FileNotFoundError(f"File not found: {file_path}")

    with open(path, "r", encoding="utf-8") as f:
        data = json.load(f)

    # Convert JSON object back to string
    json_string = json.dumps(data)

    return json_string

json_string = read_json_as_string(path)
# ---------- end json2string ----------

# ----
panel_3 = Panel(central_decall)
clean = CleanTree(RemoveNulls=True, RemoveInvalid=True, RemoveEmpty=False, Tree=central_decall)
panel_4 = Panel(json_file_path)
panel_5 = Panel(clean)

# ---- group: Output Layout
json_file_path_2 = FilePath("C:\Users\jomig\repos\AIA26_Studio\team_01\team_01_edited_layout.json")
json2string_2 = Python3Script(path=json_file_path_2)  # -> out, json_string; same code as json2string

# ----
team_04_result_cluster = Team04ResultCluster(tool_call_request=clean)  # -> tool_names_3, tool_call_success

# ----
# Tool Names from the Results Clusters
# Tool Names from the Definition Clusters
# These Two Clusters should be EXACTLY THE SAME
panel_6 = Panel(get_tool_names)
panel_7 = Panel(team_04_result_cluster.tool_names_3)

panel_8 = Panel(json_file_path_2)

# ---- group: 0 = Before, 1= After
# Visualize Layout from JSON: Before and After
number_slider = Slider(1, range=0..1)

# ----
rec = DataRecorder(team_04_result_cluster.tool_call_success, DataLimit=-10, RecordData=True)
rec_2 = DataRecorder(clean, DataLimit=-10, RecordData=True)

# ---- group: Request Parameters
decall = DeconstructToolCall(Request=clean)  # -> Request, Tool, Arguments
rjo = ReadJSONObject(JObject=decall.Arguments)  # -> Keys, JTokens
# Debug: Check request input data
panel_9 = Panel("room_name")
tmatch = MatchText(Text=rjo.Keys, Pattern=panel_9, Case=True)
tmatch_2 = MatchText(Text=rjo.Keys, Pattern="layout_json", Case=True)
dispatch = Dispatch(List=rjo.JTokens, DispatchPattern=tmatch)  # -> ListA, ListB
dispatch_2 = Dispatch(List=rjo.JTokens, DispatchPattern=tmatch_2)  # -> ListA, ListB
panel_10 = Panel(dispatch.ListA)
panel_11 = Panel(dispatch_2.ListA)

# ----
response_ok = Panel(rec)
called_tool_name = Panel(rec_2)
filter = StreamFilter(Gate=number_slider, Stream0=json2string.json_string, Stream1=json2string_2.json_string)

# ---- group: Extractor Tool do map json to grasshopper data
extractor = Python3Script(json_str=filter)  # -> out, outline_curve, room_names, room_curves, door_names, door_curves, window_names, window_curves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; same code as extractor

# ---- group: Polylines
srf = Surface(extractor.room_curves)
preview = CustomPreview(Geometry=srf, Material=[ColourSwatch(SwatchColor=RGB(167, 219, 44)), ColourSwatch(SwatchColor=RGB(4, 154, 184))])

# ---- group: Windows
data = Data(extractor.window_curves)
previewlw = CustomPreviewLineweights(Geometry=data, Shader=ColourSwatch(SwatchColor=RGB(56, 56, 56)), Thickness=Slider(5.4, range=0..10), Absolute=False)

# ---- group: Labels
area = Area(Geometry=srf)  # -> Area, Centroid
tag = TextTag(Location=area.Centroid, Text=extractor.room_names)

# ----
rebuild_curve = RebuildCurve(EndTangents=False)

# ----
# Debug Tool Names
# This Panel should always be TRUE
tool_names_from_the_results_clusters = Data(panel_7)
tool_names_from_the_definition_clusters = Data(panel_6)
join = TextJoin(Text=flatten(tool_names_from_the_definition_clusters))
join_2 = TextJoin(Text=flatten(tool_names_from_the_results_clusters))
tstat = TreeStatistics(Tree=tool_names_from_the_definition_clusters)  # -> Paths, Length, Count
tstat_2 = TreeStatistics(Tree=tool_names_from_the_results_clusters)  # -> Paths, Length, Count
dpath = DeconstructPath(Branch=tstat.Paths)
dpath_2 = DeconstructPath(Branch=tstat_2.Paths)
equals = Equality(FirstNumber=tstat.Length, SecondNumber=tstat_2.Length)  # -> Equality, Inequality
equals_2 = Equality(FirstNumber=tstat.Count, SecondNumber=tstat_2.Count)  # -> Equality, Inequality
ma = MassAddition(Input=flatten(equals.Equality))  # -> Result, PartialResults
equals_3 = Equality(FirstNumber=dpath, SecondNumber=dpath_2)  # -> Equality, Inequality
lng = ListLength(List=equals.Equality)
ma_2 = MassAddition(Input=flatten(equals_3.Inequality))  # -> Result, PartialResults
equals_4 = Equality(FirstNumber=ma.Result, SecondNumber=lng)  # -> Equality, Inequality
does_quantity_of_tools_match = Panel(equals_2.Equality)
equals_5 = Equality(FirstNumber=ma_2.Result, SecondNumber="0")  # -> Equality, Inequality
does_quantity_of_tools_match_per_team = Panel(equals_4.Equality)
are_all_teams_included = Panel(equals_5.Equality)

tmatch_3 = MatchText(Text=join, Pattern=join_2, Case=True)

do_all_names_match = Panel(tmatch_3)
and = GateAnd(A=equals_5.Equality, B=equals_4.Equality, C=equals_2.Equality, D=tmatch_3)  # -> flatten(Result)
do_trees_match = Panel(and)

# ==== cluster Team04DefinitionCluster
panel = Panel("This tool deletes a room by giving it a room name and the layout json")
panel_2 = Panel("This tool deletes a room by giving it a room name and the layout json")
# Team 04 Definition Cluster
# CYLINDER TEAM
panel_3 = Panel("This tool computes the volume of a cylinder by giving it a radius and height.  The output unit is the input unit cubed.")
panel_4 = Panel("This tool computes the area of a cylinder by giving it a radius and height.  The output unit is the input unit squared.")
define_tool_parameter = DefineToolParameter(Name="room_name", Type="string", Description="the name of the room", Required=Toggle(True))
define_tool_parameter_2 = DefineToolParameter(Name="layout_json", Type="string", Description="the layout data structure", Required=Toggle(True))
define_tool_parameter_3 = DefineToolParameter(Name="room_name", Type="string", Description="the name of the room", Required=Toggle(True))
define_tool_parameter_4 = DefineToolParameter(Name="layout_json", Type="string", Description="the layout data structure", Required=Toggle(True))
define_tool_parameter_5 = DefineToolParameter(Name="width", Type="number", Description="The width of the window", Required=Toggle(True))
define_tool_parameter_6 = DefineToolParameter(Name="Site_shape", Type="polyline", Description="site_shape", Required=Toggle(True))
define_tool_parameter_7 = DefineToolParameter(Name="number_of_trees", Type="number", Description="number of trees in the site", Required=Toggle(True))
define_tool_parameter_8 = DefineToolParameter(Name="site_boundary", Type="polyline", Description="site_shape", Required=Toggle(True))
define_tool_parameter_9 = DefineToolParameter(Name="radius_of_trees", Type="number", Description="The Radius of a Tree in the site", Required=Toggle(True))
define_tool_parameter_10 = DefineToolParameter(Name="height", Type="number", Description="The Height of a Cylinder", Required=Toggle(True))
define_tool_parameter_11 = DefineToolParameter(Name="radius", Type="number", Description="The Radius of a Cylinder", Required=Toggle(True))
define_tool_parameter_12 = DefineToolParameter(Name="height", Type="number", Description="The Height of a Cylinder", Required=Toggle(True))
define_tool_parameter_13 = DefineToolParameter(Name="radius", Type="number", Description="The Radius of a Cylinder", Required=Toggle(True))
merge = Merge(Data1=define_tool_parameter, Data2=define_tool_parameter_2)
merge_2 = Merge(Data1=define_tool_parameter_3, Data2=define_tool_parameter_5, Data3=define_tool_parameter_4)
define_tool = DefineTool(Name="delete_room_04", Description=panel, Parameters=merge)
define_tool_2 = DefineTool(Name="add_window_04", Description=panel_2, Parameters=merge_2)
merge_3 = Merge(Data1=define_tool_parameter_11, Data2=define_tool_parameter_10)
merge_4 = Merge(Data1=define_tool_parameter_13, Data2=define_tool_parameter_12)
define_tool_3 = DefineTool(Name="compute_volume_of_cylinder", Description=panel_3, Parameters=merge_3)
define_tool_4 = DefineTool(Name="compute_area_of_cylinder", Description=panel_4, Parameters=merge_4)
merge_5 = Merge(Data1=define_tool_parameter_7, Data2=define_tool_parameter_9)
define_tool_5 = DefineTool(Name="site_boundary", Description="site_boundary_constrain", Parameters=merge_5)
merge_6 = Merge(Data1=define_tool_3, Data2=define_tool_4, Data3=define_tool, Data4=define_tool_2, Data5=define_tool_5)
R = ClusterOutput(merge_6)
panel_5 = Panel(merge_6)

# ==== cluster Team04ResultCluster

# ----
# Team 04 Result Cluster
# CYLINDER TEAM
# Edit Tool Names to
# Match Definition Cluster
tool_names = Panel("""compute_volume_of_cylinder
compute_area_of_cylinder
delete_room_04
add_window_04
site_boundary""")

# ----
# Sorting Logic, Please Do Not Edit
tool_call_request = ClusterInput()
tool_names_2 = Text(tool_names)
deconstruct_tool_call = DeconstructToolCall(Request=tool_call_request)  # -> Request, Tool, Arguments
member_index = MemberIndex(Set=tool_names, Member=deconstruct_tool_call.Tool)  # -> Index, Count
sift_pattern = SiftPattern(List=deconstruct_tool_call.Request, SiftPattern=member_index.Index)  # -> Output0, Output1, Output2, Output3, Output4

# ---- group: Cluster Output
tool_names_3 = ClusterOutput(tool_names_2)

# ----
deconstruct_tool_call_2 = DeconstructToolCall(Request=sift_pattern.Output4)  # -> Request, Tool, Arguments
rectangle = Rectangle(Plane=PlaneXY(0, 0, 0), XSize=Domain(0, 80), YSize=Domain(0, 100), Radius=0)  # -> Rectangle, Length

# ---- group: Get the request sent from VSC Agent
deconstruct_tool_call_3 = DeconstructToolCall(Request=sift_pattern.Output3)  # -> Request, Tool, Arguments

# ----
deconstruct_tool_call_4 = DeconstructToolCall(Request=sift_pattern.Output0)  # -> Request, Tool, Arguments
deconstruct_tool_call_5 = DeconstructToolCall(Request=sift_pattern.Output1)  # -> Request, Tool, Arguments
deconstruct_tool_call_6 = DeconstructToolCall(Request=sift_pattern.Output2)  # -> Request, Tool, Arguments
get_json_object_key = GetJSONObjectKey(JObject=deconstruct_tool_call_2.Arguments, Key="number_of_trees")
read_json_value = ReadJSONValue(JValue=get_json_object_key)  # -> AsString, AsNumber, AsBool
get_json_object_key_2 = GetJSONObjectKey(JObject=deconstruct_tool_call_2.Arguments, Key="radius_of_trees")
get_json_object_key_3 = GetJSONObjectKey(JObject=deconstruct_tool_call_5.Arguments, Key="height")
get_json_object_key_4 = GetJSONObjectKey(JObject=deconstruct_tool_call_4.Arguments, Key="height")
get_json_object_key_5 = GetJSONObjectKey(JObject=deconstruct_tool_call_5.Arguments, Key="radius")
get_json_object_key_6 = GetJSONObjectKey(JObject=deconstruct_tool_call_4.Arguments, Key="radius")

# ---- group: Extract the tool call parameters
get_json_object_key_7 = GetJSONObjectKey(JObject=deconstruct_tool_call_3.Arguments, Key="layout_json")
get_json_object_key_8 = GetJSONObjectKey(JObject=deconstruct_tool_call_3.Arguments, Key="room_name")
get_json_object_key_9 = GetJSONObjectKey(JObject=deconstruct_tool_call_3.Arguments, Key="width")
read_json_value_2 = ReadJSONValue(JValue=get_json_object_key_7)  # -> AsString, AsNumber, AsBool

# ----
read_json_value_3 = ReadJSONValue(JValue=get_json_object_key_3)  # -> AsString, AsNumber, AsBool
read_json_value_4 = ReadJSONValue(JValue=get_json_object_key_4)  # -> AsString, AsNumber, AsBool
read_json_value_5 = ReadJSONValue(JValue=get_json_object_key_5)  # -> AsString, AsNumber, AsBool
read_json_value_6 = ReadJSONValue(JValue=get_json_object_key_6)  # -> AsString, AsNumber, AsBool
read_json_value_7 = ReadJSONValue(JValue=get_json_object_key_2)  # -> AsString, AsNumber, AsBool
populate_2d = Populate2D(Region=rectangle.Rectangle, Count=read_json_value.AsNumber, Seed=1)
get_json_object_key_10 = GetJSONObjectKey(JObject=deconstruct_tool_call_6.Arguments, Key="room_name")
get_json_object_key_11 = GetJSONObjectKey(JObject=deconstruct_tool_call_6.Arguments, Key="layout_json")
read_json_value_8 = ReadJSONValue(JValue=get_json_object_key_9)  # -> AsString, AsNumber, AsBool
cylinder = Cylinder(Base=PlaneXY(0, 0, 0), Radius=read_json_value_6.AsNumber, Length=read_json_value_4.AsNumber)
cylinder_2 = Cylinder(Base=PlaneXY(0, 0, 0), Radius=read_json_value_5.AsNumber, Length=read_json_value_3.AsNumber)
circle = Circle(Plane=populate_2d, Radius=read_json_value_7.AsNumber)
surface = Surface(rectangle.Rectangle)
read_json_value_9 = ReadJSONValue(JValue=get_json_object_key_11)  # -> AsString, AsNumber, AsBool
region_difference = RegionDifference(CurvesA=surface, CurvesB=circle)
cap_holes = CapHoles(Brep=cylinder)
cap_holes_2 = CapHoles(Brep=cylinder_2)

# ---- group: Delete a Space by name
python_3_script = Python3Script(json_str=read_json_value_9.AsString, room_name=get_json_object_key_10)  # -> out, a; inputs room_name: String
# ---------- python_3_script: Python ----------
import json
import copy

# Inputs:
# json_str -> JSON as string
# room_name -> e.g. "Kitchen"

def load_json_from_string(json_string):
    try:
        data = json.loads(json_string)
    except Exception as e:
        raise ValueError(f"Invalid JSON string: {e}")
    return data

# Load JSON
data = load_json_from_string(json_str)

# Work on a copy
filtered = copy.deepcopy(data)

# ------------------------
# 1. Find room IDs to remove
# ------------------------
ids_to_remove = set()

for room in filtered.get("rooms", []):
    if room.get("name") == room_name:
        ids_to_remove.add(room.get("id"))

# ------------------------
# 2. Remove from rooms
# ------------------------
filtered["rooms"] = [
    r for r in filtered.get("rooms", [])
    if r.get("id") not in ids_to_remove
]

# ------------------------
# 3. Remove / clean DOORS
# (remove doors that connect to deleted rooms)
# ------------------------
filtered["doors"] = [
    d for d in filtered.get("doors", [])
    if not any(rid in ids_to_remove for rid in d.get("attributes", {}).get("connectsRooms", []))
]

# ------------------------
# 4. Remove WINDOWS linked to deleted rooms
# ------------------------
filtered["windows"] = [
    w for w in filtered.get("windows", [])
    if w.get("attributes", {}).get("roomId") not in ids_to_remove
]

# ------------------------
# 5. Remove FURNITURE linked to deleted rooms
# ------------------------
filtered["furniture"] = [
    f for f in filtered.get("furniture", [])
    if f.get("attributes", {}).get("roomId") not in ids_to_remove
]

# ------------------------
# 6. (Optional) MEP cleanup
# (only if tied to rooms — currently not in your schema)
# ------------------------
# Keeping all MEP elements for now

# ------------------------
# 7. STRUCTURE
# (typically global, so we keep it)
# ------------------------

# ------------------------
# Output ONLY as string
# ------------------------
a = json.dumps(filtered, indent=2)
# ---------- end python_3_script ----------

# ----
volume = Volume(Geometry=cap_holes)  # -> Volume, Centroid
script = Script(region=region_difference)  # -> out, value; inputs region: Curve
# ---------- script: Python ----------
import json
import System
import Rhino
import Rhino.Geometry as rg

value = None

def get_geometry(item):
    if item is None:
        return None

    # If it is a Rhino object ID
    if isinstance(item, System.Guid):
        rh_obj = Rhino.RhinoDoc.ActiveDoc.Objects.FindId(item)
        if rh_obj:
            return rh_obj.Geometry
        return None

    # If it is already geometry
    if isinstance(item, rg.GeometryBase):
        return item

    return None


# Flatten input if it comes as list / tree
items = []

if region is None:
    items = []
elif hasattr(region, "Branches"):
    for branch in region.Branches:
        for item in branch:
            items.append(item)
elif isinstance(region, list):
    items = region
else:
    items = [region]


for item in items:
    geom = get_geometry(item)

    if geom is None:
        continue

    amp = rg.AreaMassProperties.Compute(geom)

    if amp is not None:
        data = {
            "name": "site_boundary",
            "type": "region_difference",
            "area": amp.Area,
            "centroid": {
                "x": amp.Centroid.X,
                "y": amp.Centroid.Y,
                "z": amp.Centroid.Z
            }
        }

        value = json.dumps(data)
        break
# ---------- end script ----------

# ---- group: Get a Specific Room
python_3_script_2 = Python3Script(json_str=read_json_value_2.AsString, room_name=get_json_object_key_8)  # -> out, a; inputs room_name: String
# ---------- python_3_script_2: Python ----------
import json
import Rhino.Geometry as rg

# Inputs:
# json_str -> JSON as string
# room_name -> e.g. "Living Room"

def load_json_from_string(json_string):
    try:
        data = json.loads(json_string)
    except Exception as e:
        raise ValueError(f"Invalid JSON string: {e}")
    return data

def create_polyline(points):
    pts = [rg.Point3d(x, y, 0) for x, y in points]

    # Ensure closed
    if pts[0] != pts[-1]:
        pts.append(pts[0])

    return rg.Polyline(pts).ToPolylineCurve()

# Load JSON
data = load_json_from_string(json_str)

# Find the room
room_curve = None

for room in data.get("rooms", []):
    if room.get("name") == room_name:
        geometry = room.get("geometry")
        if geometry:
            room_curve = create_polyline(geometry)
        break

# Output ONLY the polyline
a = room_curve
# ---------- end python_3_script_2 ----------

# ----
area = Area(Geometry=cap_holes_2)  # -> Area, Centroid
panel = Panel(script.value)
create_json_value = CreateJSONValue(Value=script.value)
parse_json_string = ParseJSONString(Text=python_3_script.a)
panel_2 = Panel(volume.Volume)
panel_3 = Panel(area.Area)
division = Division(A=read_json_value_8.AsNumber, B="2")

# ---- group: Design Logic to Add a Window
room_polyline = Data(python_3_script_2.a)
deconstruct_brep = DeconstructBrep(Brep=room_polyline)  # -> Faces, Edges, Vertices
list_item = ListItem(List=deconstruct_brep.Edges, Index=0, Wrap=True)
curve_middle = CurveMiddle(Curve=list_item)
unit_x = UnitX(Factor=division)
move = Move(Geometry=curve_middle, Motion=unit_x)  # -> Geometry, Transform
move_2 = Move(Geometry=curve_middle, Motion=expr("-x", unit_x))  # -> Geometry, Transform
merge = Merge(Data1=move.Geometry, Data2=move_2.Geometry)

# ----
list_item_2 = ListItem(List=create_json_value, Index=0, Wrap=True)
create_json_value_2 = CreateJSONValue(Value=panel_3)
create_json_value_3 = CreateJSONValue(Value=panel_2)
mcp_tool_response = MCPToolResponse(Request=deconstruct_tool_call_6.Request, Content=parse_json_string, IsError=False)
panel_4 = Panel(create_json_value)
create_json_object = CreateJSONObject(Keys="site_boundary", Values=list_item_2)
create_json_object_2 = CreateJSONObject(Keys="area", Values=create_json_value_2)
create_json_object_3 = CreateJSONObject(Keys="volume", Values=create_json_value_3)
mcp_tool_response_2 = MCPToolResponse(Request=deconstruct_tool_call_2.Request, Content=create_json_object, IsError=False)
mcp_tool_response_3 = MCPToolResponse(Request=deconstruct_tool_call_5.Request, Content=create_json_object_2, IsError=False)
mcp_tool_response_4 = MCPToolResponse(Request=deconstruct_tool_call_4.Request, Content=create_json_object_3, IsError=False)

# ---- group: Creates a Window Object
text = Text(merge)
window_object = Python3Script(element_id="window-2", name="South Window", geometry=text)  # -> out, window_obj; inputs element_id: String, geometry: list
# ---------- window_object: Python ----------
import json

def parse_point_string(pt_str):
    """
    Converts '{3.5, 0, 0}' -> [3.5, 0.0]
    """
    # Remove braces and spaces
    cleaned = pt_str.strip().replace("{", "").replace("}", "")
    
    # Split into components
    parts = cleaned.split(",")
    
    if len(parts) < 2:
        raise ValueError(f"Invalid point format: {pt_str}")
    
    x = float(parts[0])
    y = float(parts[1])
    
    return [x, y]

def serialize_geometry(geometry_list):
    """
    Converts list of GH strings into [[x,y], [x,y]]
    """
    return [parse_point_string(pt) for pt in geometry_list]

# ------------------------
# Convert geometry
# ------------------------
serialized_geometry = serialize_geometry(geometry)

# Build window object
window_obj = {
    "id": element_id,
    "name": name,
    "geometry": serialized_geometry
}

# Optional attributes
if attributes:
    window_obj["attributes"] = attributes

# Output ONLY as JSON string
window_obj = json.dumps(window_obj, indent=2)
# ---------- end window_object ----------

# ---- group: Merge it to the original layout json
python_3_script_3 = Python3Script(json_str=read_json_value_2.AsString, new_object=window_object.window_obj)  # -> out, updated_layout
# ---------- python_3_script_3: Python ----------
import json
import copy

def load_json_from_string(json_string):
    try:
        return json.loads(json_string)
    except Exception as e:
        raise ValueError(f"Invalid JSON string: {e}")

def detect_object_type(obj):
    """
    Infer target list from object id prefix.
    """
    obj_id = obj.get("id", "").lower()

    if obj_id.startswith("window"):
        return "windows"
    elif obj_id.startswith("door"):
        return "doors"
    elif obj_id.startswith("furn") or obj_id.startswith("furniture"):
        return "furniture"
    elif obj_id.startswith("mep"):
        return "mep"
    elif obj_id.startswith("wall") or obj_id.startswith("structure"):
        return "structure"
    else:
        # default fallback (safe choice)
        return "windows"

# ------------------------
# Load inputs
# ------------------------
layout = load_json_from_string(json_str)
new_object = json.loads(new_object)  # assuming object comes as JSON string

# Work on copy
updated = copy.deepcopy(layout)

# ------------------------
# Detect target category
# ------------------------
target_key = detect_object_type(new_object)

# ------------------------
# Ensure list exists
# ------------------------
if target_key not in updated:
    updated[target_key] = []

# ------------------------
# Insert object
# ------------------------
updated[target_key].append(new_object)

# ------------------------
# Output JSON string
# ------------------------
updated_layout = json.dumps(updated, indent=2)
# ---------- end python_3_script_3 ----------

# ----
merge_2 = Merge(Data1=flatten(python_3_script.a), Data2=flatten(python_3_script_3.updated_layout))
parse_json_string_2 = ParseJSONString(Text=python_3_script_3.updated_layout)

# ---- group: Extractor Tool do map json to grasshopper data
extractor = Python3Script(json_str=merge_2)  # -> out, outline_curve, room_names, room_curves, door_names, door_curves, window_names, window_curves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
# ---------- extractor: Python ----------
import json
import Rhino.Geometry as rg

def load_json_from_string(json_string):
    try:
        data = json.loads(json_string)
    except Exception as e:
        raise ValueError(f"Invalid JSON string: {e}")
    return data

def create_polyline(points, close=True):
    """Create a Rhino PolylineCurve from 2D points"""
    pts = [rg.Point3d(x, y, 0) for x, y in points]

    if close and pts[0] != pts[-1]:
        pts.append(pts[0])

    return rg.Polyline(pts).ToPolylineCurve()

def create_line(points):
    """Create a Rhino LineCurve from 2 points"""
    if len(points) != 2:
        return None
    p1 = rg.Point3d(points[0][0], points[0][1], 0)
    p2 = rg.Point3d(points[1][0], points[1][1], 0)
    return rg.LineCurve(p1, p2)

# Load JSON
layout = load_json_from_string(json_str)

# ------------------------
# ROOMS (polygons)
# ------------------------
room_names = []
room_curves = []

for room in layout.get("rooms", []):
    name = room.get("name")
    geometry = room.get("geometry")

    if name and geometry:
        curve = create_polyline(geometry, close=True)
        room_names.append(name)
        room_curves.append(curve)

# ------------------------
# DOORS (lines)
# ------------------------
door_names = []
door_curves = []

for door in layout.get("doors", []):
    name = door.get("name")
    geometry = door.get("geometry")

    if name and geometry:
        curve = create_line(geometry)
        if curve:
            door_names.append(name)
            door_curves.append(curve)

# ------------------------
# WINDOWS (lines)
# ------------------------
window_names = []
window_curves = []

for window in layout.get("windows", []):
    name = window.get("name")
    geometry = window.get("geometry")

    if name and geometry:
        curve = create_line(geometry)
        if curve:
            window_names.append(name)
            window_curves.append(curve)

# ------------------------
# FURNITURE (polygons)
# ------------------------
furniture_names = []
furniture_curves = []

for furn in layout.get("furniture", []):
    name = furn.get("name")
    geometry = furn.get("geometry")

    if name and geometry:
        curve = create_polyline(geometry, close=True)
        furniture_names.append(name)
        furniture_curves.append(curve)

# ------------------------
# MEP (polygons)
# ------------------------
mep_names = []
mep_curves = []

for m in layout.get("mep", []):
    name = m.get("name")
    geometry = m.get("geometry")

    if name and geometry:
        curve = create_polyline(geometry, close=True)
        mep_names.append(name)
        mep_curves.append(curve)

# ------------------------
# STRUCTURE (lines)
# ------------------------
structure_names = []
structure_curves = []

for s in layout.get("structure", []):
    name = s.get("name")
    geometry = s.get("geometry")

    if name and geometry:
        curve = create_line(geometry)
        if curve:
            structure_names.append(name)
            structure_curves.append(curve)

# ------------------------
# OUTLINE (optional)
# ------------------------
outline_curve = None
if "outline" in layout:
    outline_curve = create_polyline(layout["outline"], close=True)

# ------------------------
# OUTPUTS
# ------------------------
a = room_names
b = room_curves

c = door_names
d = door_curves

e = window_names
f = window_curves

g = furniture_names
h = furniture_curves

i = mep_names
j = mep_curves

k = structure_names
l = structure_curves

m = outline_curve
# ---------- end extractor ----------

# ----
mcp_tool_response_5 = MCPToolResponse(Request=deconstruct_tool_call_3.Request, Content=parse_json_string_2, IsError=False)

# ---- group: Polylines
surface_2 = Surface(extractor.room_curves)
custom_preview = CustomPreview(Geometry=surface_2, Material=[ColourSwatch(SwatchColor=RGB(167, 219, 44)), ColourSwatch(SwatchColor=RGB(4, 154, 184))])

# ---- group: Windows
data = Data(extractor.window_curves)
custom_preview_lineweights = CustomPreviewLineweights(Geometry=data, Shader=ColourSwatch(SwatchColor=RGB(56, 56, 56)), Thickness=Slider(5.4, range=0..10), Absolute=False)

# ---- group: Labels
area_2 = Area(Geometry=surface_2)  # -> Area, Centroid
text_tag = TextTag(Location=area_2.Centroid, Text=extractor.room_names)

# ----
gate_or = GateOr(A=mcp_tool_response_4, B=mcp_tool_response_3, C=mcp_tool_response, D=mcp_tool_response_5, E=mcp_tool_response_2)
tool_call_success = ClusterOutput(gate_or)
